# Grasshopper definition ghpython_00_import.ghx (Grasshopper 1.0.7)

import_statement = GhPythonScript()  # -> out
# ---------- import_statement: Python ----------
__author__ = "trtku"
__version__ = "2021.11.01"


'''
what is the import statement in python?
import is calling either module or python file into the code which you are writing now!
'''

# ex.1 import a built-in module of python.
import math
print("ex1. built-in module")
print(math)
print(type(math))

# ex.2 import a Namespace of Rhino.
#      what is the namespace?
"""    --> A namespace is a declarative region that provides a scope to 
           the identifiers (the names of types, functions, variables, etc) inside it.
           Namespaces are used to organize code into logical groups and to prevent
           name collisions that can occur especially when your code base includes multiple libraries.
           SOURCE: https://docs.microsoft.com/en-us/cpp/cpp/namespaces-cpp?view=msvc-160
"""
import Rhino
print("ex2. Namespace")
print(Rhino)
print(type(Rhino))

# ex.3 import a module which is located in the same folder as this .ghx file
import module1
print("ex3. module in the same folder")
print(module1)
print(type(module1))

# ex.4 import a module from registered path of Rhino.
#      you can check the registered path through...
#          2-1. "EditPytonScript" command in rhino
#          2-2. "Tools" tab in the top of the windows
#          2-3. "Options..."
#          2-4. you can find "Module Search Path"
import compas
print("ex4. registered path")
print(compas)
print(type(compas))

'''
once you import a module, its "scope" is only in this python component.
what is "scope"? --->  https://www.pythonlikeyoumeanit.com/Module2_EssentialsOfPython/Scope.html
'''
# ---------- end import_statement ----------
