# Grasshopper definition ghpython_06_class.ghx (Grasshopper 1.0.7)

beginner_class = GhPythonScript()  # -> out
# ---------- beginner_class: Python ----------
__author__ = "trtku"
__version__ = "2021.11.03"

'''
a class is an extensible program-code-template
for creating objects, providing initial values
for state (member variables)
and implementations of behavior (member functions or methods)
SOURCE: https://en.wikipedia.org/wiki/Class_(computer_programming)

simply speaking,
class normally has attributes and method,
which is defined by user.
'''


# ex.1 simple class structure
class Beginner(object):
    pass

b = Beginner()
print("b", b, type(b))
# ---------- end beginner_class ----------
elementary_class = GhPythonScript()  # -> out
# ---------- elementary_class: Python ----------
__author__ = "trtku"
__version__ = "2021.11.03"


# ex.2 simple class with attributes and methods (or property and function)
class Elementary(object):
    
    # this is a class variable
    attr0 = "class variable"
    
    # initiate function which will automatically run and initiate object when the class is called.
    def __init__(self, argument):
        # these are instance variable
        self.attr1 = "hardcoded"
        self.attr2 = argument
        
        # this is an attribute defined by internal method
        self.attr5 = self.method5(argument)
        
    # this is a method which will run only if it's called.
    def method0(self):
        print("you call the method0")
        
    # this is a method with input argument.
    def method1(self, argument1):
        print("this is the method1. the argument is ", argument1)
        
    # this is a method with input argument and return.
    def method2(self, argument2):
        result = argument2 * 10
        print("this is the method2. the argument is {}, the result is {}".format(argument2, result))
        return result
        
    # this is a method with input argument which will create a new attribute
    def method3(self, argument3):
        self.attr3 = argument3
        
    # this is a method with input argument which will create a new attribute and return
    def method4(self, argument4):
        self.attr4 = argument4
        return self.attr4
        
    # this is a method which will be called in the __init__ funtion.
    def method5(self, argument):
        characters = []
        for c in argument:
            characters.append(c)
        return characters


# call object
e = Elementary(argument="argument") # at this moment, __init__ function is already called.
print("e", e, type(e))

# call attributes
print("attr0", e.attr0, type(e.attr0))
print("attr1", e.attr1, type(e.attr1))
print("attr2", e.attr2, type(e.attr2))

# call method0
e.method0()

# call method1
e.method1(1)

# call method2 and assign returned value into variable(=result)
var2 = e.method2(2)
print(var2)

# call method3
e.method3(3)
# call updated attribute by method3
print("attr3", e.attr3)

# call method4
var4 = e.method4(4)
# call updated attribute by method4
print("attr4", e.attr4)
print("var4", var4)

# call attr5
print("attr5", e.attr5, type(e.attr5))
# ---------- end elementary_class ----------
mas_class = GhPythonScript()  # -> out
# ---------- mas_class: Python ----------
__author__ = "trtku"
__version__ = "2021.11.03"


# ex.3 example class structure
class MAS(object):
    
    # these are class variable
    ADDRESS = "Honggreberg"
    
    # this init method.
    def __init__(self, year, student_num, tutor_num):
        # these are instance variable from arguments
        self.year = year
        self.student_num = student_num
        self.tutor_num = tutor_num
        
        # these are instance variable from hard coded values
        self.intro = False
        self.T1 = False
        self.T2 = False
        self.T3 = False
        
    # this is a method with arguments and return
    def grouping(self, student_per_group):
        group_num = int(self.student_num / student_per_group)
        half_num = self.student_num % student_per_group
        return group_num, half_num
        
    ## this is a method with arguments(=month in this case) which will update attribute
    def course(self, month):
        if month == 1:
            self.intro = True
            print("intro is done!")
        if month == 3:
            self.T1 = True
            print("T1 is done!")
        if month == 9:
            self.T2 = True
            print("T2 is done!")
        if month == 12:
            self.T3 = True


# call class
mas2021 = MAS(2021, 17, 2)
print(mas2021.ADDRESS)
print(mas2021.year)

# call a method
group_num, half_num = mas2021.grouping(3)
print("group_num: {}\nhalf_num: {}".format(group_num, half_num))

# update attributes by calling method
for month in range(12):
    mas2021.course(month+1)
    print("course_procedure in {}th month\nintro: {}\nT1: {}\nT2: {}\nT3: {}".format(month+1, mas2021.intro, mas2021.T1, mas2021.T2, mas2021.T3))
# ---------- end mas_class ----------
