# Grasshopper definition 00_Structure_Point_and_Vector.ghx (Grasshopper 1.0.7)

# ---- group: constructor
# note: SOURCE:
# 
# https://developer.rhino3d.com/guides/general/essential-mathematics/vector-mathematics/
point_structures = GhPythonScript()  # -> out, pt3d, pt3f, pt2d, pt2f, pt4d
# ---------- point_structures: Python ----------
__author__ = "trtku"
__version__ = "2021.11.09"

'''
This is a basic documentation about Point structure in Rhino.Geometry
'''

import Rhino.Geometry as rg



# 0. First of all, there are two different types of representation in rhinocommon: one is class and another one is structure.
#    Basically, structure is memory efficient. See source below if you are curious.
#    https://www.grasshopper3d.com/forum/topics/rhinocommon-structure-types


# 1. Point3d Structure
#    https://developer.rhino3d.com/api/RhinoCommon/html/T_Rhino_Geometry_Point3d.htm
#    what is double?  --->  https://en.wikipedia.org/wiki/Double-precision_floating-point_format
pt3d = rg.Point3d(1, 0, 0)
print('Point3d', pt3d, type(pt3d))


# 2. Point3f Structure
#    https://developer.rhino3d.com/api/RhinoCommon/html/M_Rhino_Geometry_Point3f__ctor.htm
#    what is single?  --->  https://en.wikipedia.org/wiki/Single-precision_floating-point_format
pt3f = rg.Point3f(2, 0, 0)
print('Point3f', pt3f, type(pt3f))


'''This is more memory efficient if you need only 2 dimensional points'''
# 3. Point2d Structure
#    https://developer.rhino3d.com/api/RhinoCommon/html/T_Rhino_Geometry_Point2d.htm
pt2d = rg.Point2d(3, 0)
print('Point2d', pt2d, type(pt2d))


# 4. Point2f Structure
#    https://developer.rhino3d.com/api/RhinoCommon/html/T_Rhino_Geometry_Point2f.htm
pt2f = rg.Point2f(4, 0)
print('Point2f', pt2f, type(pt2f))


'''This helpful if you create weighted curve for example'''
# 5. Point4d Structure
#    https://developer.rhino3d.com/api/RhinoCommon/html/T_Rhino_Geometry_Point4d.htm
pt4d = rg.Point4d(5, 0, 0, 0)
print('Point4d', pt4d, type(pt4d))
# ---------- end point_structures ----------
vector_structures = GhPythonScript()  # -> out, vec3d, vec3f, vec2d, vec2f
# ---------- vector_structures: Python ----------
__author__ = "trtku"
__version__ = "2021.11.09"

'''
This is a basic documentation about Vector structure in Rhino.Geometry
'''

import Rhino.Geometry as rg


# 0. First of all, there are two different types of representation in rhinocommon: one is class and another one is structure.
#    Basically, structure is memory efficient. See source below if you are curious.
#    https://www.grasshopper3d.com/forum/topics/rhinocommon-structure-types


# 1. Vector3d Structure
#    https://developer.rhino3d.com/api/RhinoCommon/html/T_Rhino_Geometry_Vector3d.htm
#    what is double?  --->  https://en.wikipedia.org/wiki/Double-precision_floating-point_format
vec3d = rg.Vector3d(1, 0, 0)
print('Vector3d', vec3d, type(vec3d))


# 2. Vector3f Structure
#    https://developer.rhino3d.com/api/RhinoCommon/html/T_Rhino_Geometry_Vector3f.htm
#    what is single?  --->  https://en.wikipedia.org/wiki/Single-precision_floating-point_format
vec3f = rg.Vector3f(2, 0, 0)
print('Vector3f', vec3f, type(vec3f))


'''This is more memory efficient if you need only 2 dimensional points'''
# 3. Vector2d Structure
#    https://developer.rhino3d.com/api/RhinoCommon/html/T_Rhino_Geometry_Vector3f.htm
vec2d = rg.Vector2d(3, 0)
print('Vector2d', vec2d, type(vec2d))


# 4. Vector2f Structure
#    https://developer.rhino3d.com/api/RhinoCommon/html/T_Rhino_Geometry_Vector2f.htm
vec2f = rg.Vector2f(4, 0)
print('Vector2f', vec2f, type(vec2f))
# ---------- end vector_structures ----------

# ---- group: properties
vector_structures_properties = GhPythonScript()  # -> out, vec3d
# ---------- vector_structures_properties: Python ----------
__author__ = "trtku"
__version__ = "2021.11.09"

'''
This is a basic documentation about Vector structures properties in Rhino.Geometry
'''

import Rhino.Geometry as rg


# 0. Basically, double precision structure covers all of the properties and methods of single precision.


# 1. constructor
vec3d = rg.Vector3d(1, 2, 3)
print('Vector3d', vec3d, type(vec3d))


# 2. properties
print('IsUnitVector', vec3d.IsUnitVector)

print('IsValid', vec3d.IsValid)

print('IsZero', vec3d.IsZero)

print('Item', vec3d.Item)
print('Item[0]', vec3d.Item[0])
print('Item[1]', vec3d.Item[1])
print('Item[2]', vec3d.Item[2])

print('Length', vec3d.Length)

print('MaximumCoordinate', vec3d.MaximumCoordinate)

print('MinimumCoordinate', vec3d.MinimumCoordinate)

print('SquareLength', vec3d.SquareLength)

print('Unset', vec3d.Unset)

print('X', vec3d.X)

print('Y', vec3d.Y)

print('Z', vec3d.Z)

print('XAxis', vec3d.XAxis)

print('YAxis', vec3d.YAxis)

print('ZAxis', vec3d.ZAxis)

print('Zero', vec3d.Zero)
# ---------- end vector_structures_properties ----------
point_structures_properties = GhPythonScript()  # -> out, pt3d
# ---------- point_structures_properties: Python ----------
__author__ = "trtku"
__version__ = "2021.11.09"

'''
This is a basic documentation about Point structures properties in Rhino.Geometry
'''

import Rhino.Geometry as rg


# 0. Basically, double precision structure covers all of the properties and methods of single precision.


# 1. constructor
pt3d = rg.Point3d(1, 2, 3)
print('Point3d', pt3d, type(pt3d))


# 2. properties
print('IsValid', pt3d.IsValid)

print('Item', pt3d.Item)
print('Item[0]', pt3d.Item[0])
print('Item[1]', pt3d.Item[1])
print('Item[2]', pt3d.Item[2])

print('MaximumCoordinate', pt3d.MaximumCoordinate)

print('MinimumCoordinate', pt3d.MinimumCoordinate)

print('Origin', pt3d.Origin)

print('Unset', pt3d.Unset)

print('X', pt3d.X)

print('Y', pt3d.Y)

print('Z', pt3d.Z)
# ---------- end point_structures_properties ----------

# ---- group: methods
vector_structures_methods = GhPythonScript()  # -> out, pt3d
# ---------- vector_structures_methods: Python ----------
__author__ = "trtku"
__version__ = "2021.11.09"

'''
This is a basic documentation about Vector structures methods in Rhino.Geometry
'''

import Rhino.Geometry as rg


# 1. constructor
vec3d_o = rg.Vector3d(0, 0, 0)
vec3d_a = rg.Vector3d(1, 2, 3)
vec3d_b = rg.Vector3d(3, 2, 1)
print('vec3d_a', vec3d_a, type(vec3d_a))
print('vec3d_b', vec3d_b, type(vec3d_b))


# 2. methods

# Utilize
unit = vec3d_a.Unitize()
print('Unitize', unit)

# VectorAngle
angle = rg.Vector3d.VectorAngle(vec3d_a, vec3d_b)
print('VectorAngle_a', angle, '(in radians)')
# you can specify the plane
angle = rg.Vector3d.VectorAngle(vec3d_a, vec3d_b, rg.Plane.WorldXY)
print('VectorAngle_b', angle, '(in radians)')

# CrossProduct
cross = rg.Vector3d.CrossProduct(vec3d_a, vec3d_b)
print('CrossProduct', cross)

# Multiply (=dot product)
dot = rg.Vector3d.Multiply(vec3d_a, vec3d_b)
print('Dot Product', dot)

# Length
length = vec3d_a.Length
print('Length', length)

# Divide
div = rg.Vector3d.Divide(vec3d_a, 2)
print('Divide', div)
print('Length after Divide', div.Length)

# Nagate
neg = rg.Vector3d.Negate(vec3d_a)
print('Negate', neg)

# Reverse
rev = rg.Vector3d.Reverse(vec3d_a)
print('Reverse', rev)

# Transform
T = rg.Transform.Translation(rg.Vector3d(10,20,30)) # for transform structure, see 01_Transform_Structure
vec_before = rg.Vector3d(10,10,10)
vec_after = vec_before.Clone()
vec_after.Transform(T)
print('Transform', vec_before==vec_after)
print('vec_before', vec_before)
print('vec_after', vec_after)

# Rotate
import math as m
vec_before = rg.Vector3d.XAxis
vec_after = vec_before.Clone()
vec_after.Rotate(m.radians(90), rg.Vector3d.ZAxis)
print('Rotate', vec_before==vec_after)
print('Rotate', vec_after)
# ---------- end vector_structures_methods ----------
point_structures_methods = GhPythonScript()  # -> out, pt3d, pt3d_b, pts, pts_culled, pt3d_c, random_pts, pts_sorted_culled, pt3d_d
# ---------- point_structures_methods: Python ----------
__author__ = "trtku"
__version__ = "2021.11.09"

'''
This is a basic documentation about Point structures methods in Rhino.Geometry
'''

import Rhino.Geometry as rg


# 1. constructor
pt3d = rg.Point3d(1, 2, 3)
print('Point3d', pt3d, type(pt3d))


# 2. methods

# 2-1. Transform
T = rg.Transform.Translation(10, 10, 10)  # for transform structure, see 01_Transform_Structure
pt3d_b = pt3d.Clone()
pt3d_b.Transform(T)
print('Transform', pt3d_b)

# 2-2. distance to
pt3d_c = rg.Point3d(1, 2, 3)
dist = pt3d.DistanceTo(pt3d_c)
print('DistanceTo', dist)

# 2-3. cull duplicates
pts = [rg.Point3d(0,0,0) for i in range(10)]
tol = 0.01
pts_culled = rg.Point3d.CullDuplicates(pts, tol)
print('Cullduplicates', pts==pts_culled)
print('pts', len(pts), pts)
print('pts_culled', len(pts_culled), pts_culled)

# 2-4. SortAndCullPointList
import random as r
random_pts = [rg.Point3d(r.random(), r.random(), 0) for i in range(10)]
pts_sorted_culled = rg.Point3d.SortAndCullPointList(random_pts, 0.01)
print('SortAndCullPointList', random_pts==pts_sorted_culled)

# 2-5. compare to
comparison = rg.Point3d.CompareTo(pt3d, pt3d_b)
print('CompareTo', comparison)

# 2-6. Equals
pt3d_d = rg.Point3d(0, 0, 0)
EE = rg.Point3d.Equals(pt3d, pt3d_c)
EE2 = rg.Point3d.Equals(pt3d, pt3d_d)
print('Equals', EE)
print('Equals', EE2)

# 2-7. GetType
type_is = pt3d.GetType()
print('GetType', type_is)

# 2-8. ToString
pt_string = pt3d.ToString()
print('ToString', pt_string)

# 2-9. TryParse
import clr
out = clr.StrongBox[rg.Point3d]()
success = rg.Point3d.TryParse(pt_string, out)
print('TryParse', pt_string, out)
# ---------- end point_structures_methods ----------

# ----
pline = PolyLine(Vertices=point_structures_methods.random_pts, Closed=False)
pline_2 = PolyLine(Vertices=point_structures_methods.pts_sorted_culled, Closed=False)
