# Grasshopper definition 01_Structure_Transform.ghx (Grasshopper 1.0.7)

# ---- group: constructor
# note: SOURCE:
# 
# https://developer.rhino3d.com/guides/general/essential-mathematics/matrices-transformations/
transform_structure_constructor = GhPythonScript()  # -> out, pt, pt1
# ---------- transform_structure_constructor: Python ----------
__author__ = "trtku"
__version__ = "2021.11.10"

'''
This is a basic documentation about Transform structure in Rhino.Geometry
'''

import Rhino.Geometry as rg


# 0. First of all, there are two different types of representation in rhinocommon: one is class and another one is structure.
#    Transform is belong to Structure in rhinocommon
#    Basically, structure is memory efficient. See source below if you are curious.
#    https://www.grasshopper3d.com/forum/topics/rhinocommon-structure-types

# prepare a original point
pt = rg.Point3d(0,0,0)
print('original point', type(pt), pt)

# 1. Transform Structure
#    https://developer.rhino3d.com/api/RhinoCommon/html/T_Rhino_Geometry_Transform.htm
#    what is double?  --->  https://en.wikipedia.org/wiki/Double-precision_floating-point_format

# 1-1. how to set Transformatino matrix manually by defining diagonal values (barely used)
#    https://developer.rhino3d.com/api/RhinoCommon/html/M_Rhino_Geometry_Transform__ctor_1.htm
T1 = rg.Transform(1)
print('T1', type(T1), T1)
# transform the original point
pt1 = pt.Clone()
pt1.Transform(T1)
print('pt1', type(pt1), pt1)
# ---------- end transform_structure_constructor ----------

# ---- group: properties
transform_structure_properties = GhPythonScript()  # -> out
# ---------- transform_structure_properties: Python ----------
__author__ = "trtku"
__version__ = "2021.11.10"

'''
This is a basic documentation about Transform structure in Rhino.Geometry
'''

import Rhino.Geometry as rg


# 0. Properties of Transform structure are basely used. If you are curious, please see source below.
#    https://developer.rhino3d.com/api/RhinoCommon/html/T_Rhino_Geometry_Transform.htm
# ---------- end transform_structure_properties ----------

# ---- group: methods
transform_structure_methods = GhPythonScript()  # -> out, pt, pt1, pt2, pt3, pt4, pt5, pt6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
# ---------- transform_structure_methods: Python ----------
__author__ = "trtku"
__version__ = "2021.11.10"

'''
This is a basic documentation about Transform structure in Rhino.Geometry
'''

import Rhino.Geometry as rg


# 0. First of all, there are two different types of representation in rhinocommon: one is class and another one is structure.
#    Transform is belong to Structure in rhinocommon
#    Basically, structure is memory efficient. See source below if you are curious.
#    https://www.grasshopper3d.com/forum/topics/rhinocommon-structure-types

# prepare a original point
pt = rg.Point3d(10,0,0)
print('original point', type(pt), pt)


# 1. Transform Methods
#    https://developer.rhino3d.com/api/RhinoCommon/html/T_Rhino_Geometry_Transform.htm


# Mirror

# Mirror method type1
#    https://developer.rhino3d.com/api/RhinoCommon/html/M_Rhino_Geometry_Transform_Mirror.htm
mirror_plane = rg.Plane.WorldYZ
T1 = rg.Transform.Mirror(mirror_plane)
pt1 = pt.Clone()
pt1.Transform(T1)

# Mirror method type2
#    https://developer.rhino3d.com/api/RhinoCommon/html/M_Rhino_Geometry_Transform_Mirror_1.htm
T2 = rg.Transform.Mirror(rg.Point3d.Origin, rg.Vector3d.XAxis)
pt2 = pt.Clone()
pt2.Transform(T2)
# check the result
print('T1', type(T1), T1)
print('T2', type(T2), T2)
print('Result are same', pt1==pt2)


# comparison methods
# CompareTo
#    https://developer.rhino3d.com/api/RhinoCommon/html/M_Rhino_Geometry_Transform_CompareTo.htm
comparison = rg.Transform.CompareTo(T1, T2)
print('comparison', type(comparison), comparison)
# Equals
#    https://developer.rhino3d.com/api/RhinoCommon/html/M_Rhino_Geometry_Transform_Equals.htm
equals = rg.Transform.Equals(T1, T2)
print('equals', type(equals), equals)


# PlaneToPlane
#    https://developer.rhino3d.com/api/RhinoCommon/html/M_Rhino_Geometry_Transform_PlaneToPlane.htm
# set plane from and to
plane_from = rg.Plane.WorldXY
plane_to = rg.Plane(pt, rg.Vector3d.ZAxis)
T3 = rg.Transform.PlaneToPlane(plane_from, plane_to)
pt3 = pt.Clone()
pt3.Transform(T3)
print('PlaneToPlane', type(T3), T3)
print('pt3', type(pt3), pt3)


# Projection

# PlanarProjection
#    https://developer.rhino3d.com/api/RhinoCommon/html/M_Rhino_Geometry_Transform_PlanarProjection.htm
plane_to_project = rg.Plane.WorldYZ
T4 = rg.Transform.PlanarProjection(plane_to_project)
pt4 = pt.Clone()
pt4.Transform(T4)
print('Projection type1', type(T4), T4)
print('pt4', type(pt4), pt4)

# ProjectAlong
#    https://developer.rhino3d.com/api/RhinoCommon/html/M_Rhino_Geometry_Transform_ProjectAlong.htm
direction = rg.Vector3d(1, 1, 0)
T5 = rg.Transform.ProjectAlong(plane_to_project, direction)
pt5 = pt.Clone()
pt5.Transform(T5)
print('Projection type2', type(T5), T5)
print('pt5', type(pt5), pt5)


# Rotation

# Rotation method type1
#    https://developer.rhino3d.com/api/RhinoCommon/html/M_Rhino_Geometry_Transform_Rotation_2.htm
import math as m
rotation_angle = m.radians(30)
rotation_center = rg.Point3d.Origin
T6 = rg.Transform.Rotation(rotation_angle, rotation_center)
pt6 = pt.Clone()
pt6.Transform(T6)
print('Rotation type1', type(T6), T6)
print('pt6', type(pt6), pt6)

# Rotation method type2
#    https://developer.rhino3d.com/api/RhinoCommon/html/M_Rhino_Geometry_Transform_Rotation_3.htm
rotation_angle = m.radians(30)
rotation_axis = rg.Vector3d.YAxis
rotation_center = rg.Point3d.Origin
T7 = rg.Transform.Rotation(rotation_angle, rotation_axis, rotation_center)
pt7 = pt.Clone()
pt7.Transform(T7)
print('Rotation type2', type(T7), T7)
print('pt7', type(pt7), pt7)

# Rotation method type3
#    https://developer.rhino3d.com/api/RhinoCommon/html/M_Rhino_Geometry_Transform_Rotation.htm
start_direction = rg.Vector3d(1, 1, 1)
end_direction = rg.Vector3d(1, 2, 3)
rotation_center = rg.Point3d.Origin
T8 = rg.Transform.Rotation(start_direction, end_direction, rotation_center)
pt8 = pt.Clone()
pt8.Transform(T8)
print('Rotation type3', type(T8), T8)
print('pt8', type(pt8), pt8)


# Scale

# Scale method type1
#    https://developer.rhino3d.com/api/RhinoCommon/html/M_Rhino_Geometry_Transform_Scale_1.htm
point_to_scale = rg.Point3d(1, 2, -3)
anchor = rg.Point3d.Origin
scale_factor = 3
T9 = rg.Transform.Scale(anchor, scale_factor)
pt9 = point_to_scale.Clone()
pt9.Transform(T9)
print('Scale type1', type(T9), T9)
print('pt9', type(pt9), pt9)

# Scale method type2
#    https://developer.rhino3d.com/api/RhinoCommon/html/M_Rhino_Geometry_Transform_Scale.htm
plane = rg.Plane.WorldXY
x_scale_factor = 2
y_scale_factor = 3
z_scale_factor = 4
T10 = rg.Transform.Scale(plane, x_scale_factor, y_scale_factor, z_scale_factor)
pt10 = point_to_scale.Clone()
pt10.Transform(T10)
print('Scale type2', type(T10), T10)
print('pt10', type(pt10), pt10)


# Translation (~move)

# translation method type1
#    https://developer.rhino3d.com/api/RhinoCommon/html/M_Rhino_Geometry_Transform_Translation.htm
motion = rg.Vector3d(20, 20, 20)
T11 = rg.Transform.Translation(motion)
pt11 = pt.Clone()
pt11.Transform(T11)
print('Translation type1', type(T11), T11)
print('pt11', type(pt11), pt11)

# translation method type2
#    https://developer.rhino3d.com/api/RhinoCommon/html/M_Rhino_Geometry_Transform_Translation_1.htm
T12 = rg.Transform.Translation(30, 30, 30)
pt12 = pt.Clone()
pt12.Transform(T12)
print('Translation type2', type(T12), T12)
print('pt12', type(pt12), pt12)


# Multiply (compatible to '*' operator)
#    https://developer.rhino3d.com/api/RhinoCommon/html/M_Rhino_Geometry_Transform_Multiply.htm
T_first = rg.Transform.Translation(50, 0, 0)
T_second = rg.Transform.Translation(0, -50, 0)
T13 = rg.Transform.Multiply(T_second, T_first)
pt13 = pt.Clone()
pt13.Transform(T13)
print('Multiply', type(T13), T13)
print('pt13', type(pt13), pt13)
# ---------- end transform_structure_methods ----------
