# Grasshopper definition 02_Structure_Primitives.ghx (Grasshopper 1.0.7)

# ---- group: Circle / Arc / Cylinder
circle_arc_cylinder_constructor = GhPythonScript()  # -> out, ci1, ci2, ci3, ci4, ci5, ci6, arc1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
# ---------- circle_arc_cylinder_constructor: Python ----------
__author__ = "trtku"
__version__ = "2021.11.10"

'''
This is a basic documentation about Circle/Arc/Cylinder structure in Rhino.Geometry
'''

import Rhino.Geometry as rg


# 0. First of all, there are two different types of representation in rhinocommon: one is class and another one is structure.
#    Transform is belong to Structure in rhinocommon
#    Basically, structure is memory efficient. See source below if you are curious.
#    https://www.grasshopper3d.com/forum/topics/rhinocommon-structure-types


# A-1. Circle Structure
#    https://developer.rhino3d.com/api/RhinoCommon/html/T_Rhino_Geometry_Circle.htm


# A-2. Circle constructor
#    https://developer.rhino3d.com/api/RhinoCommon/html/Overload_Rhino_Geometry_Circle__ctor.htm

# A-2-1. Circle constructor type1
#    https://developer.rhino3d.com/api/RhinoCommon/html/M_Rhino_Geometry_Circle__ctor_6.htm
radius = 5
ci1 = rg.Circle(radius)
print('ci1', type(ci1), ci1)

# A-2-2. Circle constructor type2
#    https://developer.rhino3d.com/api/RhinoCommon/html/M_Rhino_Geometry_Circle__ctor_2.htm
plane = rg.Plane.WorldYZ
radius = 5
ci2 = rg.Circle(plane, radius)
print('ci2', type(ci2), ci2)

# A-2-3. Circle constructor type3
#    https://developer.rhino3d.com/api/RhinoCommon/html/M_Rhino_Geometry_Circle__ctor_5.htm
center = rg.Point3d(5, 5, 5)
radius = 5
ci3 = rg.Circle(center, radius)
print('ci3', type(ci3), ci3)

# A-2-4. Circle constructor type4
#    https://developer.rhino3d.com/api/RhinoCommon/html/M_Rhino_Geometry_Circle__ctor_1.htm
plane = rg.Plane.WorldYZ
center = rg.Point3d(5, 5, 5)
radius = 5
ci4 = rg.Circle(plane, center, radius)
print('ci4', type(ci4), ci4)

# A-2-5. Circle constructor type5
#    https://developer.rhino3d.com/api/RhinoCommon/html/M_Rhino_Geometry_Circle__ctor_3.htm
point1 = rg.Point3d(0, 0, 0)
point2 = rg.Point3d(5, 0, 5)
point3 = rg.Point3d(0, 10, 10)
ci5 = rg.Circle(point1, point2, point3)
print('ci5', type(ci5), ci5)

# A-2-6. Circle constructor type6
#    https://developer.rhino3d.com/api/RhinoCommon/html/M_Rhino_Geometry_Circle__ctor_4.htm
start_point = rg.Point3d(0, 0, 0)
tangent_at_point = rg.Vector3d(1, 0, 0)
point_on_circle = rg.Point3d(0, 10, 10)
ci6 = rg.Circle(start_point, tangent_at_point, point_on_circle)
print('ci6', type(ci6), ci6)


#####################################################################################################################################


# B-1. Arc Structure
#    https://developer.rhino3d.com/api/RhinoCommon/html/T_Rhino_Geometry_Arc.htm


# B-2. Arc constructor
#    https://developer.rhino3d.com/api/RhinoCommon/html/Overload_Rhino_Geometry_Arc__ctor.htm

# B-2-1. Arc constructor type1
#    https://developer.rhino3d.com/api/RhinoCommon/html/M_Rhino_Geometry_Arc__ctor.htm
import math as m
radius = 20
angleIntervalRadians = rg.Interval(m.radians(45), m.radians(90))
ci = rg.Circle(radius)
arc1 = rg.Arc(ci, angleIntervalRadians)
print('arc1', type(arc1), arc1)

# B-2-2. Arc constructor type2
#    https://developer.rhino3d.com/api/RhinoCommon/html/M_Rhino_Geometry_Arc__ctor_1.htm
angleRadians = m.radians(30)
arc2 = rg.Arc(ci, angleRadians)
print('arc2', type(arc2), arc2)

# B-2-3. Arc constructor type3
#    https://developer.rhino3d.com/api/RhinoCommon/html/M_Rhino_Geometry_Arc__ctor_3.htm
plane = rg.Plane.WorldYZ
arc3 = rg.Arc(plane, radius, angleRadians)
print('arc3', type(arc3), arc3)

# B-2-4. Arc constructor type4
#    https://developer.rhino3d.com/api/RhinoCommon/html/M_Rhino_Geometry_Arc__ctor_3.htm
start_point = rg.Point3d(0, 10, 0)
point_on_interior = rg.Point3d(0, 0, 0)
end_point = rg.Point3d(-10, 0, 15)
arc4 = rg.Arc(start_point, point_on_interior, end_point)
print('arc4', type(arc4), arc4)

# B-2-5. Arc constructor type5
#    https://developer.rhino3d.com/api/RhinoCommon/html/M_Rhino_Geometry_Arc__ctor_5.htm
point_a = rg.Point3d(10, 0, 0)
tangent_a = rg.Vector3d(0, 1, 0)
point_b = rg.Point3d(0, -10, 20)
arc5 = rg.Arc(point_a, tangent_a, point_b)
print('arc5', type(arc5), arc5)

# B-2-6. Arc constructor type6
#    https://developer.rhino3d.com/api/RhinoCommon/html/M_Rhino_Geometry_Arc__ctor_6.htm
center = rg.Point3d(15, 15, 15)
arc6 = rg.Arc(center, radius, angleRadians)
print('arc6', type(arc6), arc6)

# B-2-7. Arc constructor type7
#    https://developer.rhino3d.com/api/RhinoCommon/html/M_Rhino_Geometry_Arc__ctor_2.htm
center = rg.Point3d(15, 15, 15)
arc7 = rg.Arc(plane, center, radius, angleRadians)
print('arc7', type(arc7), arc7)




#####################################################################################################################################



# C-1. Cylinder Structure
#    https://developer.rhino3d.com/api/RhinoCommon/html/T_Rhino_Geometry_Cylinder.htm


# C-2. Cylinder constructor
#    https://developer.rhino3d.com/api/RhinoCommon/html/Overload_Rhino_Geometry_Cylinder__ctor.htm

# C-2-1. Cylinder constructor type1
#    https://developer.rhino3d.com/api/RhinoCommon/html/M_Rhino_Geometry_Cylinder__ctor_1.htm
height = 50
cy1 = rg.Cylinder(ci1, height)
print('cy1', type(cy1), cy1)
# ---------- end circle_arc_cylinder_constructor ----------
circle_arc_cylinder_properties = GhPythonScript()  # -> out, ci1, bbox, center, plane, arc1, end_pt, mid_pt, cy1, base_pl
# ---------- circle_arc_cylinder_properties: Python ----------
__author__ = "trtku"
__version__ = "2021.11.10"

'''
This is a basic documentation about Circle/Arc/Cylinder structure in Rhino.Geometry
'''

import Rhino.Geometry as rg


# 0. First of all, there are two different types of representation in rhinocommon: one is class and another one is structure.
#    Transform is belong to Structure in rhinocommon
#    Basically, structure is memory efficient. See source below if you are curious.
#    https://www.grasshopper3d.com/forum/topics/rhinocommon-structure-types


# A-1. Circle Structure
#    https://developer.rhino3d.com/api/RhinoCommon/html/T_Rhino_Geometry_Circle.htm


# A-2. Circle constructor
#    https://developer.rhino3d.com/api/RhinoCommon/html/Overload_Rhino_Geometry_Circle__ctor.htm

# A-2-1. Circle constructor type1
#    https://developer.rhino3d.com/api/RhinoCommon/html/M_Rhino_Geometry_Circle__ctor_6.htm
radius = 5
ci1 = rg.Circle(radius)
print('ci1', type(ci1), ci1)


# A-3. Circle Properties
#    https://developer.rhino3d.com/api/RhinoCommon/html/Properties_T_Rhino_Geometry_Circle.htm

# A-3-1. BoundingBox
bbox = ci1.BoundingBox
print('bbox', type(bbox), bbox)

# A-3-2. Center
center = ci1.Center
print('center', type(center), center)

# A-3-3. Circumference
circumference = ci1.Circumference
print('circumference', type(circumference), circumference)

# A-3-4. Diameter
diameter = ci1.Diameter
print('diameter', type(diameter), diameter)

# A-3-5. IsValid
is_valid = ci1.IsValid
print('is_valid', type(is_valid), is_valid)

# A-3-6. Normal
normal = ci1.Normal
print('noemal', type(normal), normal)

# A-3-7. Plane
plane = ci1.Plane
print('plane', type(plane), plane)

# A-3-8. Radius
radius_prop = ci1.Radius
print('radius_prop', type(radius_prop), radius_prop)



#####################################################################################################################################



# B-1. Arc Structure
#    https://developer.rhino3d.com/api/RhinoCommon/html/T_Rhino_Geometry_Arc.htm


# B-2. Arc constructor
#    https://developer.rhino3d.com/api/RhinoCommon/html/Overload_Rhino_Geometry_Arc__ctor.htm

# B-2-1. Arc constructor type1
#    https://developer.rhino3d.com/api/RhinoCommon/html/M_Rhino_Geometry_Arc__ctor.htm
import math as m
radius = 20
angleIntervalRadians = rg.Interval(m.radians(45), m.radians(90))
ci = rg.Circle(radius)
arc1 = rg.Arc(ci, angleIntervalRadians)
print('arc1', type(arc1), arc1)


# B-3. Arc Properties
#    https://developer.rhino3d.com/api/RhinoCommon/html/Properties_T_Rhino_Geometry_Arc.htm

'''arc properties which have same name to the circle are skipped ("Center" for ex)'''

# B-3-1. Angle
angle = arc1.Angle
print('angle(radians)', type(angle), angle)

# B-3-2. AngleDegrees
angle_d = arc1.AngleDegrees
print('angle_d(degrees)', type(angle_d), angle_d)

# B-3-3. AngleDomain
domain = arc1.AngleDomain
print('domain', type(domain), domain)

# B-3-4. AngleDomain
domain = arc1.AngleDomain
print('domain', type(domain), domain)

# B-3-5. Start/EndAngle
end_angle = arc1.EndAngle
print('end_angle', type(end_angle), end_angle)

# B-3-6. StartEndAngleDegrees
end_angle_d = arc1.EndAngleDegrees
print('end_angle_d', type(end_angle_d), end_angle_d)

# B-3-7. Start/EndPoint
end_pt = arc1.EndPoint
print('end_pt', type(end_pt), end_pt)

# B-3-8. MidPoint
mid_pt = arc1.MidPoint
print('mid_pt', type(mid_pt), mid_pt)


#####################################################################################################################################



# C-1. Cylinder Structure
#    https://developer.rhino3d.com/api/RhinoCommon/html/T_Rhino_Geometry_Cylinder.htm


# C-2. Cylinder constructor
#    https://developer.rhino3d.com/api/RhinoCommon/html/Overload_Rhino_Geometry_Cylinder__ctor.htm

# C-2-1. Cylinder constructor type1
#    https://developer.rhino3d.com/api/RhinoCommon/html/M_Rhino_Geometry_Cylinder__ctor_1.htm
height = 50
cy1 = rg.Cylinder(ci1, height)
print('cy1', type(cy1), cy1)


# C-3. Cylinder Properties
#    https://developer.rhino3d.com/api/RhinoCommon/html/Properties_T_Rhino_Geometry_Cylinder.htm

'''cylinder properties which have same name to the circle are skipped ("Center" for ex)'''

# C-3-1. Axis
axis = cy1.Axis
print('axis', type(axis), axis)

# C-3-2. BasePlane
base_pl = cy1.BasePlane
print('base_pl', type(base_pl), base_pl)

# C-3-3. Height1/2
height1 = cy1.Height1
height2 = cy1.Height2
print('height1', type(height1), height1)
print('height2', type(height2), height2)

# C-3-4. TotalHeight
total_height = cy1.TotalHeight
print('total_height ', type(total_height ), total_height )
# ---------- end circle_arc_cylinder_properties ----------
circle_arc_cylinder_methods = GhPythonScript()  # -> out, ci1, bbox, pt_at, reversed, nurbs, nurbs_b, ci_to_transform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
# ---------- circle_arc_cylinder_methods: Python ----------
__author__ = "trtku"
__version__ = "2021.11.10"

'''
This is a basic documentation about Circle/Arc/Cylinder structure in Rhino.Geometry
'''

import Rhino.Geometry as rg


# 0. First of all, there are two different types of representation in rhinocommon: one is class and another one is structure.
#    Transform is belong to Structure in rhinocommon
#    Basically, structure is memory efficient. See source below if you are curious.
#    https://www.grasshopper3d.com/forum/topics/rhinocommon-structure-types


# A-1. Circle Structure
#    https://developer.rhino3d.com/api/RhinoCommon/html/T_Rhino_Geometry_Circle.htm


# A-2. Circle constructor
#    https://developer.rhino3d.com/api/RhinoCommon/html/Overload_Rhino_Geometry_Circle__ctor.htm

# A-2-1. Circle constructor type1
#    https://developer.rhino3d.com/api/RhinoCommon/html/M_Rhino_Geometry_Circle__ctor_6.htm
radius = 5
ci1 = rg.Circle(radius)
print('ci1', type(ci1), ci1)


# A-3. Circle Methods
#    https://developer.rhino3d.com/api/RhinoCommon/html/Methods_T_Rhino_Geometry_Circle.htm

# A-3-1. ClosestPoint
#    https://developer.rhino3d.com/api/RhinoCommon/html/M_Rhino_Geometry_Circle_ClosestPoint.htm
bbox = ci1.BoundingBox
print('bbox', type(bbox), bbox)

# A-3-2. DerivativeAt
#    https://developer.rhino3d.com/api/RhinoCommon/html/M_Rhino_Geometry_Circle_DerivativeAt.htm
Nth = 0
param = 0
nth_derivative = ci1.DerivativeAt(Nth, param)
print('nth_derivative', type(nth_derivative), nth_derivative)

# A-3-3. IsInPlane
#    https://developer.rhino3d.com/api/RhinoCommon/html/M_Rhino_Geometry_Circle_IsInPlane.htm
is_in_plane = ci1.IsInPlane(rg.Plane.WorldXY, 0.01)
print('is_in_plane', type(is_in_plane), is_in_plane)

# A-3-4. PointAt
#    https://developer.rhino3d.com/api/RhinoCommon/html/M_Rhino_Geometry_Circle_PointAt.htm
pt_at = ci1.PointAt(param)
print('pt_at', type(pt_at), pt_at)

# A-3-5. Reverse
#    https://developer.rhino3d.com/api/RhinoCommon/html/M_Rhino_Geometry_Circle_Reverse.htm
reversed = ci1.Clone()
reversed.Reverse()
print('reversed', ci1.PointAt(0.5) == reversed.PointAt(0.5))
print('reversed', type(reversed), reversed)

# A-3-6. TangentAt
#    https://developer.rhino3d.com/api/RhinoCommon/html/M_Rhino_Geometry_Circle_TangentAt.htm
tan = ci1.TangentAt(param)
print('tan', type(tan), tan)

# A-3-7. ToNurbsCurve type1
#    https://developer.rhino3d.com/api/RhinoCommon/html/M_Rhino_Geometry_Circle_ToNurbsCurve.htm
nurbs = ci1.ToNurbsCurve()
print('nurbs', type(nurbs), nurbs)

# A-3-8. ToNurbsCurve type2
#    https://developer.rhino3d.com/api/RhinoCommon/html/M_Rhino_Geometry_Circle_ToNurbsCurve_1.htm
degree = 1
cvCount = 5
nurbs_b = ci1.ToNurbsCurve(degree, cvCount)
print('nurbs_b', type(nurbs_b), nurbs_b)

# A-3-9. Transform
ci_to_transform = ci1.Clone()
T = rg.Transform.Translation(-10, -10, -10)
ci_to_transform.Transform(T)
print('ci_to_transform', type(ci_to_transform), ci_to_transform)



#####################################################################################################################################



# B-1. Arc Structure
#    https://developer.rhino3d.com/api/RhinoCommon/html/T_Rhino_Geometry_Arc.htm


# B-2. Arc constructor
#    https://developer.rhino3d.com/api/RhinoCommon/html/Overload_Rhino_Geometry_Arc__ctor.htm

# B-2-1. Arc constructor type1
#    https://developer.rhino3d.com/api/RhinoCommon/html/M_Rhino_Geometry_Arc__ctor.htm
import math as m
radius = 20
angleIntervalRadians = rg.Interval(m.radians(45), m.radians(90))
ci = rg.Circle(radius)
arc1 = rg.Arc(ci, angleIntervalRadians)
print('arc1', type(arc1), arc1)


# B-3. Arc Methods
#    https://developer.rhino3d.com/api/RhinoCommon/html/Methods_T_Rhino_Geometry_Arc.htm

'''arc methods which have same name to the circle are skipped ("BoundingBox" for ex)'''

# B-3-1. Trim
#    https://developer.rhino3d.com/api/RhinoCommon/html/M_Rhino_Geometry_Arc_Trim.htm
interval = rg.Interval(0, 0.1)
arc_to_trim = arc1.Clone()
success = arc_to_trim.Trim(interval)
print('success', type(success), success)



#####################################################################################################################################



# C-1. Cylinder Structure
#    https://developer.rhino3d.com/api/RhinoCommon/html/T_Rhino_Geometry_Cylinder.htm


# C-2. Cylinder constructor
#    https://developer.rhino3d.com/api/RhinoCommon/html/Overload_Rhino_Geometry_Cylinder__ctor.htm

# C-2-1. Cylinder constructor type1
#    https://developer.rhino3d.com/api/RhinoCommon/html/M_Rhino_Geometry_Cylinder__ctor_1.htm
height = 50
cy1 = rg.Cylinder(ci1, height)
print('cy1', type(cy1), cy1)


# C-3. Cylinder Methods
#    https://developer.rhino3d.com/api/RhinoCommon/html/Methods_T_Rhino_Geometry_Cylinder.htm

# C-3-1. CircleAt
#    https://developer.rhino3d.com/api/RhinoCommon/html/M_Rhino_Geometry_Cylinder_CircleAt.htm
ci = cy1.CircleAt(20)
print('ci', type(ci), ci)

# C-3-2. LineAt
#    https://developer.rhino3d.com/api/RhinoCommon/html/M_Rhino_Geometry_Cylinder_LineAt.htm
angular_param = m.radians(45)
line = cy1.LineAt(angular_param)
print('line', type(line), line)

# C-3-3. ToBrep
#    https://developer.rhino3d.com/api/RhinoCommon/html/M_Rhino_Geometry_Cylinder_ToBrep.htm
brep = cy1.ToBrep(True, False)
print('brep', type(brep), brep)

# C-3-4. ToNurbsSurface
#    https://developer.rhino3d.com/api/RhinoCommon/html/M_Rhino_Geometry_Cylinder_ToNurbsSurface.htm
nurbs_srf = cy1.ToNurbsSurface()
print('nurbs_srf', type(nurbs_srf), nurbs_srf)

# C-3-5. ToRevSurface
#    https://developer.rhino3d.com/api/RhinoCommon/html/M_Rhino_Geometry_Cylinder_ToNurbsSurface.htm
rev_srf = cy1.ToRevSurface()
print('rev_srf', type(rev_srf), rev_srf)
# ---------- end circle_arc_cylinder_methods ----------

# ---- group: Box / BoundingBox
box_bbox_constructor = GhPythonScript()  # -> out, random_points, box, bbox1, point_a, point_b, bbox2, bbox3
# ---------- box_bbox_constructor: Python ----------
__author__ = "trtku"
__version__ = "2021.11.10"

'''
This is a basic documentation about Box/BoundingBox structure in Rhino.Geometry
'''

import Rhino.Geometry as rg


# 0. First of all, there are two different types of representation in rhinocommon: one is class and another one is structure.
#    Transform is belong to Structure in rhinocommon
#    Basically, structure is memory efficient. See source below if you are curious.
#    https://www.grasshopper3d.com/forum/topics/rhinocommon-structure-types


# A-1. Box Structure
#    https://developer.rhino3d.com/api/RhinoCommon/html/T_Rhino_Geometry_Box.htm


# A-2. Box constructor
#    https://developer.rhino3d.com/api/RhinoCommon/html/Overload_Rhino_Geometry_Box__ctor.htm

# A-2-1. Box constructor
#    https://developer.rhino3d.com/api/RhinoCommon/html/M_Rhino_Geometry_Box__ctor_3.htm
plane = rg.Plane.WorldXY
x_size = rg.Interval(-10, 15)
y_size = rg.Interval(-20, 25)
z_size = rg.Interval(-30, 35)
box = rg.Box(plane, x_size, y_size, z_size)



#######################################################################################################



# B-1. BoundingBox Structure
#    https://developer.rhino3d.com/api/RhinoCommon/html/T_Rhino_Geometry_BoundingBox.htm


# B-2. BoundingBox constructor
#    https://developer.rhino3d.com/api/RhinoCommon/html/Overload_Rhino_Geometry_BoundingBox__ctor.htm

# B-2-1. BoundingBox constructor type1
#    https://developer.rhino3d.com/api/RhinoCommon/html/M_Rhino_Geometry_BoundingBox__ctor_1.htm
import random as r
random_points = [rg.Point3d(r.random(), r.random(), r.random()) for i in range(10)]
bbox1 = rg.BoundingBox(random_points)

# B-2-2. BoundingBox constructor type2
#    https://developer.rhino3d.com/api/RhinoCommon/html/M_Rhino_Geometry_BoundingBox__ctor.htm
point_a = rg.Point3d(5, 5, 5)
point_b = rg.Point3d(-5, -5, -5)
bbox2 = rg.BoundingBox(point_a, point_b)

# B-2-3. BoundingBox constructor type3
#    https://developer.rhino3d.com/api/RhinoCommon/html/M_Rhino_Geometry_BoundingBox__ctor_3.htm
bbox3 = rg.BoundingBox(-1, -2, -3, 4, 5, 6)
# ---------- end box_bbox_constructor ----------
box_bbox_properties = GhPythonScript()  # -> out, plane, box, bbox, center, plane_b, bbox1, max, min
# ---------- box_bbox_properties: Python ----------
__author__ = "trtku"
__version__ = "2021.11.10"

'''
This is a basic documentation about Box/BoundingBox structure in Rhino.Geometry
'''

import Rhino.Geometry as rg


# 0. First of all, there are two different types of representation in rhinocommon: one is class and another one is structure.
#    Transform is belong to Structure in rhinocommon
#    Basically, structure is memory efficient. See source below if you are curious.
#    https://www.grasshopper3d.com/forum/topics/rhinocommon-structure-types


# A-1. Box Structure
#    https://developer.rhino3d.com/api/RhinoCommon/html/T_Rhino_Geometry_Box.htm


# A-2. Box constructor
#    https://developer.rhino3d.com/api/RhinoCommon/html/Overload_Rhino_Geometry_Box__ctor.htm

# A-2-1. Box constructor
#    https://developer.rhino3d.com/api/RhinoCommon/html/M_Rhino_Geometry_Box__ctor_3.htm
plane = rg.Plane.WorldXY
x_size = rg.Interval(-10, 15)
y_size = rg.Interval(-20, 25)
z_size = rg.Interval(-30, 35)
box = rg.Box(plane, x_size, y_size, z_size)


# A-3. Box Properties
#    https://developer.rhino3d.com/api/RhinoCommon/html/Properties_T_Rhino_Geometry_Box.htm

# Area
area = box.Area
print('area', type(area), area)

# BoundingBox
bbox = box.BoundingBox
print('bbox', type(bbox), bbox)

# Center
center = box.Center
print('center', type(center), center)

# Plane
plane_b = box.Plane
print('plane_b', type(plane_b), plane_b)

# Volume
volume = box.Volume
print('volume', type(volume), volume)

# X/Y/Z
x = box.X
print('x', type(x), x)



#######################################################################################################



# B-1. BoundingBox Structure
#    https://developer.rhino3d.com/api/RhinoCommon/html/T_Rhino_Geometry_BoundingBox.htm


# B-2. BoundingBox constructor
#    https://developer.rhino3d.com/api/RhinoCommon/html/Overload_Rhino_Geometry_BoundingBox__ctor.htm

# B-2-1. BoundingBox constructor type1
#    https://developer.rhino3d.com/api/RhinoCommon/html/M_Rhino_Geometry_BoundingBox__ctor_1.htm
import random as r
random_points = [rg.Point3d(r.random(), r.random(), r.random()) for i in range(10)]
bbox1 = rg.BoundingBox(random_points)

# B-2-2. BoundingBox properties
#    https://developer.rhino3d.com/api/RhinoCommon/html/Properties_T_Rhino_Geometry_BoundingBox.htm

'''bbox properties which have same name to the box are skipped ("Area" for ex)'''

# Diagonal
diagonal = bbox1.Diagonal
print('diagonal', type(diagonal), diagonal)

# Max
max = bbox1.Max
print('max', type(max), max)

# Min
min = bbox1.Min
print('min', type(min), min)
# ---------- end box_bbox_properties ----------
box_bbox_methods = GhPythonScript()  # -> out, plane, box, furthest, corners, brep, union, bbox2, inersection
# ---------- box_bbox_methods: Python ----------
__author__ = "trtku"
__version__ = "2021.11.10"

'''
This is a basic documentation about Box/BoundingBox structure in Rhino.Geometry
'''

import Rhino.Geometry as rg


# 0. First of all, there are two different types of representation in rhinocommon: one is class and another one is structure.
#    Transform is belong to Structure in rhinocommon
#    Basically, structure is memory efficient. See source below if you are curious.
#    https://www.grasshopper3d.com/forum/topics/rhinocommon-structure-types


# A-1. Box Structure
#    https://developer.rhino3d.com/api/RhinoCommon/html/T_Rhino_Geometry_Box.htm


# A-2. Box constructor
#    https://developer.rhino3d.com/api/RhinoCommon/html/Overload_Rhino_Geometry_Box__ctor.htm

# A-2-1. Box constructor
#    https://developer.rhino3d.com/api/RhinoCommon/html/M_Rhino_Geometry_Box__ctor_3.htm
plane = rg.Plane.WorldXY
x_size = rg.Interval(-10, 15)
y_size = rg.Interval(-20, 25)
z_size = rg.Interval(-30, 35)
box = rg.Box(plane, x_size, y_size, z_size)


# A-3. Box Methods
#    https://developer.rhino3d.com/api/RhinoCommon/html/Methods_T_Rhino_Geometry_Box.htm

'''box methods which have same name to the circle are skipped ("ClosestPoint" for ex)'''

# A-3-1. Contains
#    https://developer.rhino3d.com/api/RhinoCommon/html/M_Rhino_Geometry_Box_Contains_4.htm
pt = rg.Point3d(0, 0, 0)
judge = box.Contains(pt)
print('judge', type(judge), judge)

# A-3-2. FurthestPoint
#    https://developer.rhino3d.com/api/RhinoCommon/html/M_Rhino_Geometry_Box_FurthestPoint.htm
furthest = box.FurthestPoint(pt)
print('furthest', type(furthest), furthest)

# A-3-3. GetCorners
#    https://developer.rhino3d.com/api/RhinoCommon/html/M_Rhino_Geometry_Box_GetCorners.htm
corners = box.GetCorners()
print('corners', type(corners), corners)

# A-3-4. ToBrep
#    https://developer.rhino3d.com/api/RhinoCommon/html/M_Rhino_Geometry_Box_ToBrep.htm
brep = box.ToBrep()
print('brep', type(brep), brep)

# A-3-5. ToExtrusion
#    https://developer.rhino3d.com/api/RhinoCommon/html/M_Rhino_Geometry_Box_ToExtrusion.htm
extrusion = box.ToExtrusion()
print('extrusion', type(extrusion), extrusion)

# A-3-6. Union
#    https://developer.rhino3d.com/api/RhinoCommon/html/M_Rhino_Geometry_Box_Union.htm
test_point = rg.Point3d(50, 50, 50)
union = box.Union(test_point)
print('union', type(union), union)



#######################################################################################################



# B-1. BoundingBox Structure
#    https://developer.rhino3d.com/api/RhinoCommon/html/T_Rhino_Geometry_BoundingBox.htm


# B-2. BoundingBox constructor
#    https://developer.rhino3d.com/api/RhinoCommon/html/Overload_Rhino_Geometry_BoundingBox__ctor.htm

# B-2-1. BoundingBox constructor type1
#    https://developer.rhino3d.com/api/RhinoCommon/html/M_Rhino_Geometry_BoundingBox__ctor_1.htm
import random as r
random_points = [rg.Point3d(r.random(), r.random(), r.random()) for i in range(10)]
bbox1 = rg.BoundingBox(random_points)


# B-3. BoundingBox methods
#    https://developer.rhino3d.com/api/RhinoCommon/html/Methods_T_Rhino_Geometry_BoundingBox.htm

'''bbox methods which have same name to the box are skipped ("ClosestPoint" for ex)'''

# B-3-1. Intersection
random_points2 = [rg.Point3d(r.random(), r.random(), r.random()) for i in range(10)]
bbox2 = rg.BoundingBox(random_points2)
inersection = rg.BoundingBox.Intersection(bbox1, bbox2)
print('inersection', type(inersection), inersection)
# ---------- end box_bbox_methods ----------

# ---- group: Plane
# Primitive Geometries in Structure
plane_constructor = GhPythonScript()  # -> out, pl1, pl2, pl3
# ---------- plane_constructor: Python ----------
__author__ = "trtku"
__version__ = "2021.11.10"

'''
This is a basic documentation about Plane structure in Rhino.Geometry
'''

import Rhino.Geometry as rg


# 0. First of all, there are two different types of representation in rhinocommon: one is class and another one is structure.
#    Transform is belong to Structure in rhinocommon
#    Basically, structure is memory efficient. See source below if you are curious.
#    https://www.grasshopper3d.com/forum/topics/rhinocommon-structure-types

# prepare a original point
pt = rg.Point3d(0,0,0)
print('original point', type(pt), pt)


# 1. Plane Structure
#    https://developer.rhino3d.com/api/RhinoCommon/html/T_Rhino_Geometry_Plane.htm


# 2. Plane constructor
#    https://developer.rhino3d.com/api/RhinoCommon/html/Overload_Rhino_Geometry_Plane__ctor.htm

# 2-1. Plane constructor type1
#    https://developer.rhino3d.com/api/RhinoCommon/html/M_Rhino_Geometry_Plane__ctor_2.htm
center = rg.Point3d.Origin
normal = rg.Vector3d.ZAxis
pl1 = rg.Plane(center, normal)
print('pl1', type(pl1), pl1)

# 2-2. Plane constructor type2
#    https://developer.rhino3d.com/api/RhinoCommon/html/M_Rhino_Geometry_Plane__ctor_1.htm
origin = rg.Point3d.Origin
x_point = rg.Point3d(1, 0, 0)
y_point = rg.Point3d(0, 1, 0)
pl2 = rg.Plane(origin, x_point, y_point)
print('pl2', type(pl2), pl2)

# 2-3. Plane constructor type3
#    https://developer.rhino3d.com/api/RhinoCommon/html/M_Rhino_Geometry_Plane__ctor_3.htm
origin = rg.Point3d.Origin
x_direction = rg.Vector3d(1, 0, 0)
y_direction = rg.Vector3d(0, 1, 0)
pl3 = rg.Plane(origin, x_point, y_point)
print('pl3', type(pl3), pl3)
# ---------- end plane_constructor ----------
plane_properties = GhPythonScript()  # -> out, pl
# ---------- plane_properties: Python ----------
__author__ = "trtku"
__version__ = "2021.11.10"

'''
This is a basic documentation about Plane structure in Rhino.Geometry
'''

import Rhino.Geometry as rg


# 0. First of all, there are two different types of representation in rhinocommon: one is class and another one is structure.
#    Transform is belong to Structure in rhinocommon
#    Basically, structure is memory efficient. See source below if you are curious.
#    https://www.grasshopper3d.com/forum/topics/rhinocommon-structure-types

# prepare a original point
pt = rg.Point3d(0,0,0)
print('original point', type(pt), pt)


# 1. Plane Structure
#    https://developer.rhino3d.com/api/RhinoCommon/html/T_Rhino_Geometry_Plane.htm


# 2. Plane constructor
#    https://developer.rhino3d.com/api/RhinoCommon/html/Overload_Rhino_Geometry_Plane__ctor.htm

# 2-1. Plane constructor type1
#    https://developer.rhino3d.com/api/RhinoCommon/html/M_Rhino_Geometry_Plane__ctor_2.htm
center = rg.Point3d.Origin
normal = rg.Vector3d.ZAxis
pl = rg.Plane(center, normal)
print('pl', type(pl), pl)


# 3. Plane properties
#    https://developer.rhino3d.com/api/RhinoCommon/html/Properties_T_Rhino_Geometry_Plane.htm

# IsValid
isvalid = pl.IsValid
print('IsValid', type(isvalid), isvalid)

# Normal
normal = pl.Normal
print('Normal', type(normal), normal)

# Origin
origin = pl.Origin
print('Origin', type(origin), origin)

# OriginX
origin_x = pl.OriginX
print('OriginX', type(origin_x), origin_x)

# OriginY
origin_y = pl.OriginY
print('OriginY', type(origin_y), origin_y)

# OriginZ
origin_z = pl.OriginZ
print('OriginZ', type(origin_z), origin_z)

# WorldXY
world_xy = rg.Plane.WorldXY
print('world_xy', type(world_xy), world_xy)

# WorldYZ
world_yz = rg.Plane.WorldYZ
print('world_yz', type(world_yz), world_yz)

# WorldZX
world_zx = rg.Plane.WorldZX
print('world_zx', type(world_zx), world_zx)

# XAxis
x_axis = pl.XAxis
print('x_axis', type(x_axis), x_axis)

# YAxis
y_axis = pl.YAxis
print('y_axis', type(y_axis), y_axis)

# ZAxis
z_axis = pl.ZAxis
print('z_axis', type(z_axis), z_axis)
# ---------- end plane_properties ----------
plane_methods = GhPythonScript()  # -> out, pl, pl1, pt, random_pts, fit_plane, pl2, pt_remapped, pl_to_transform
# ---------- plane_methods: Python ----------
__author__ = "trtku"
__version__ = "2021.11.10"

'''
This is a basic documentation about Plane structure in Rhino.Geometry
'''

import Rhino.Geometry as rg


# 0. First of all, there are two different types of representation in rhinocommon: one is class and another one is structure.
#    Transform is belong to Structure in rhinocommon
#    Basically, structure is memory efficient. See source below if you are curious.
#    https://www.grasshopper3d.com/forum/topics/rhinocommon-structure-types

# prepare a original point
pt = rg.Point3d(0,0,0)
print('original point', type(pt), pt)


# 1. Plane Structure
#    https://developer.rhino3d.com/api/RhinoCommon/html/T_Rhino_Geometry_Plane.htm


# 2. Plane constructor
#    https://developer.rhino3d.com/api/RhinoCommon/html/Overload_Rhino_Geometry_Plane__ctor.htm

# 2-1. Plane constructor type1
#    https://developer.rhino3d.com/api/RhinoCommon/html/M_Rhino_Geometry_Plane__ctor_2.htm
center = rg.Point3d.Origin
normal = rg.Vector3d.ZAxis
pl = rg.Plane(center, normal)
print('pl', type(pl), pl)


# 3. Plane methods
#    https://developer.rhino3d.com/api/RhinoCommon/html/Methods_T_Rhino_Geometry_Plane.htm

# 3-1. Clone
#    https://developer.rhino3d.com/api/RhinoCommon/html/M_Rhino_Geometry_Plane_Clone.htm
pl1 = pl.Clone()
print("Clone", pl==pl1)
print("Clone", type(pl1), pl1)

# 3-2. ClosestPoint
#    https://developer.rhino3d.com/api/RhinoCommon/html/M_Rhino_Geometry_Plane_ClosestPoint.htm
# set test point
pt = rg.Point3d(1, 1, 1)
closest_point = pl.ClosestPoint(pt)
print("closest_point", type(closest_point), closest_point)

# 3-3. DistanceTo
#    https://developer.rhino3d.com/api/RhinoCommon/html/M_Rhino_Geometry_Plane_DistanceTo_1.htm
dist = pl.DistanceTo(pt)
print("dist", type(dist), dist)

# 3-4. FitPlaneToPoints
#    https://developer.rhino3d.com/api/RhinoCommon/html/M_Rhino_Geometry_Plane_FitPlaneToPoints.htm
import random as r
random_pts = [rg.Point3d(r.random(), r.random(), r.random()) for i in range(10)]
results = rg.Plane.FitPlaneToPoints(random_pts)
judgement = results[0]
fit_plane = results[1]
print("results", type(results), results)
print("judgement", type(judgement), judgement)
print("fit_plane", type(fit_plane), fit_plane)

# 3-5. Flip
#    https://developer.rhino3d.com/api/RhinoCommon/html/M_Rhino_Geometry_Plane_Flip.htm
pl2 = pl.Clone()
pl2.Flip()
print("Flip", type(pl2), pl2)

# 3-6. RemapToPlaneSpace
#    https://developer.rhino3d.com/api/RhinoCommon/html/M_Rhino_Geometry_Plane_RemapToPlaneSpace.htm
pt_remapped = fit_plane.RemapToPlaneSpace(pt)
print("pt_remapped", type(pt_remapped), pt_remapped)

# 3-7. Transform
#    https://developer.rhino3d.com/api/RhinoCommon/html/M_Rhino_Geometry_Plane_Transform.htm
T = rg.Transform.Translation(10, 10, 10)
pl_to_transform = pl.Clone()
pl_to_transform.Transform(T)
print("pl_to_transform", type(pl_to_transform), pl_to_transform)
# ---------- end plane_methods ----------

# ---- group: Interval
interval_constructor = GhPythonScript()  # -> out
# ---------- interval_constructor: Python ----------
__author__ = "trtku"
__version__ = "2021.11.10"

'''
This is a basic documentation about Interval structure in Rhino.Geometry
'''

import Rhino.Geometry as rg


# 0. First of all, there are two different types of representation in rhinocommon: one is class and another one is structure.
#    Transform is belong to Structure in rhinocommon
#    Basically, structure is memory efficient. See source below if you are curious.
#    https://www.grasshopper3d.com/forum/topics/rhinocommon-structure-types


# 1. Interval Structure
#    https://developer.rhino3d.com/api/RhinoCommon/html/T_Rhino_Geometry_Interval.htm


# 2. Interval constructor
#    https://developer.rhino3d.com/api/RhinoCommon/html/Overload_Rhino_Geometry_Interval__ctor.htm

# 2-1. Interval constructor type1
#    https://developer.rhino3d.com/api/RhinoCommon/html/M_Rhino_Geometry_Interval__ctor_1.htm
first_value = -5
second_value = 5
interval = rg.Interval(first_value, second_value)
print('interval', type(interval), interval)
# ---------- end interval_constructor ----------
interval_properties = GhPythonScript()  # -> out
# ---------- interval_properties: Python ----------
__author__ = "trtku"
__version__ = "2021.11.10"

'''
This is a basic documentation about Interval structure in Rhino.Geometry
'''

import Rhino.Geometry as rg


# 0. First of all, there are two different types of representation in rhinocommon: one is class and another one is structure.
#    Transform is belong to Structure in rhinocommon
#    Basically, structure is memory efficient. See source below if you are curious.
#    https://www.grasshopper3d.com/forum/topics/rhinocommon-structure-types


# 1. Interval Structure
#    https://developer.rhino3d.com/api/RhinoCommon/html/T_Rhino_Geometry_Interval.htm


# 2. Interval constructor
#    https://developer.rhino3d.com/api/RhinoCommon/html/Overload_Rhino_Geometry_Interval__ctor.htm

# 2-1. Interval constructor type1
#    https://developer.rhino3d.com/api/RhinoCommon/html/M_Rhino_Geometry_Interval__ctor_1.htm
first_value = -5
second_value = 5
interval = rg.Interval(first_value, second_value)
print('interval', type(interval), interval)

# 3. Interval properties
#    https://developer.rhino3d.com/api/RhinoCommon/html/Properties_T_Rhino_Geometry_Interval.htm

# 3-1. IsDecreasing
is_decreasing = interval.IsDecreasing
print("is_decreasing", type(is_decreasing), is_decreasing)

# 3-2. IsIncreasing
is_inncreasing = interval.IsIncreasing
print("is_inncreasing", type(is_inncreasing), is_inncreasing)

# 3-3. IsSingleton
is_singleton = interval.IsSingleton
print("is_singleton", type(is_singleton), is_singleton)

# 3-4. IsValid
is_valid = interval.IsValid
print("is_valid", type(is_valid), is_valid)

# 3-5. Item
item = interval.Item
print("item", type(item), item)
print("item[0]", type(item[0]), item[0])
print("item[1]", type(item[1]), item[1])

# 3-6. Length
length = interval.Length
print("length", type(length), length)

# 3-7. Max
max_interval = interval.Max
print("max_interval", type(max_interval), max_interval)

# 3-8. Min
min_interval = interval.Min
print("min_interval", type(min_interval), min_interval)

# 3-9. Mid
mid_interval = interval.Mid
print("mid_interval", type(mid_interval), mid_interval)
# ---------- end interval_properties ----------
interval_methods = GhPythonScript()  # -> out
# ---------- interval_methods: Python ----------
__author__ = "trtku"
__version__ = "2021.11.10"

'''
This is a basic documentation about Interval structure in Rhino.Geometry
'''

import Rhino.Geometry as rg


# 0. First of all, there are two different types of representation in rhinocommon: one is class and another one is structure.
#    Transform is belong to Structure in rhinocommon
#    Basically, structure is memory efficient. See source below if you are curious.
#    https://www.grasshopper3d.com/forum/topics/rhinocommon-structure-types


# 1. Interval Structure
#    https://developer.rhino3d.com/api/RhinoCommon/html/T_Rhino_Geometry_Interval.htm


# 2. Interval constructor
#    https://developer.rhino3d.com/api/RhinoCommon/html/Overload_Rhino_Geometry_Interval__ctor.htm

# 2-1. Interval constructor type1
#    https://developer.rhino3d.com/api/RhinoCommon/html/M_Rhino_Geometry_Interval__ctor_1.htm
first_value_a = -5
second_value_a = 5
interval_a = rg.Interval(first_value_a, second_value_a)
print('interval_a', type(interval_a), interval_a)

first_value_b = 0
second_value_b = 10
interval_b = rg.Interval(first_value_b, second_value_b)
print('interval_b', type(interval_b), interval_b)

# 3. Interval methods
#    https://developer.rhino3d.com/api/RhinoCommon/html/Methods_T_Rhino_Geometry_Interval.htm

# 3-1. FromIntersection
intersecting_interval = rg.Interval.FromIntersection(interval_a, interval_b)
print("intersecting_interval", type(intersecting_interval), intersecting_interval)

# 3-2. FromUnion
union_interval = rg.Interval.FromUnion(interval_a, interval_b)
print("union_interval", type(union_interval), union_interval)

# 3-3. Grow
interval_a.Grow(100)
print("grow", type(interval_a), interval_a)

# 3-4. MakeIncreasing
interval_negative = rg.Interval(1, -1)
print("interval_negative", type(interval_negative), interval_negative)
interval_negative.MakeIncreasing()
print("interval_negative", type(interval_negative), interval_negative)

# 3-5. Reverse
interval_c = rg.Interval(-2, 4)
interval_c.Reverse()
print("interval_c", type(interval_c), interval_c)

# 3-5. Swap
interval_d = rg.Interval(-2, 4)
interval_d.Swap()
print("interval_d", type(interval_d), interval_d)
# ---------- end interval_methods ----------

# ---- group: cone
cone = GhPythonScript()  # -> out, cone, apexpoint
# ---------- cone: Python ----------
__author__ = "trtku"
__version__ = "2021.11.10"

'''
This is a basic documentation about Cone structure in Rhino.Geometry
'''

import Rhino.Geometry as rg


# 0. First of all, there are two different types of representation in rhinocommon: one is class and another one is structure.
#    Transform is belong to Structure in rhinocommon
#    Basically, structure is memory efficient. See source below if you are curious.
#    https://www.grasshopper3d.com/forum/topics/rhinocommon-structure-types


# A-1. Cone Structure
#    https://developer.rhino3d.com/api/RhinoCommon/html/T_Rhino_Geometry_Cone.htm


# A-2. Cone constructor
#    https://developer.rhino3d.com/api/RhinoCommon/html/M_Rhino_Geometry_Cone__ctor.htm
plane = rg.Plane.WorldXY
height = 10
radius = 5
cone = rg.Cone(plane, height, radius)


# A-3. Cone properties
#    https://developer.rhino3d.com/api/RhinoCommon/html/Properties_T_Rhino_Geometry_Cone.htm

'''cone properties which have same name to the circle/arc/cylinder are skipped ("Axis" for ex)'''

# ApexPoint
apexpoint = cone.ApexPoint
print('apexpoint', type(apexpoint), apexpoint)


# A-4. Cone methods
#    https://developer.rhino3d.com/api/RhinoCommon/html/Methods_T_Rhino_Geometry_Cone.htm

'''cone methods which have same name to the circle/arc/cylinder/box are skipped ("AngleInDegrees" or "ToBrep" for ex)'''
# ---------- end cone ----------

# ---- group: sphere
sphere = GhPythonScript()  # -> out, sphere1, sphere2, north_pole, latitude
# ---------- sphere: Python ----------
__author__ = "trtku"
__version__ = "2021.11.10"

'''
This is a basic documentation about Sphere structure in Rhino.Geometry
'''

import Rhino.Geometry as rg


# 0. First of all, there are two different types of representation in rhinocommon: one is class and another one is structure.
#    Transform is belong to Structure in rhinocommon
#    Basically, structure is memory efficient. See source below if you are curious.
#    https://www.grasshopper3d.com/forum/topics/rhinocommon-structure-types


# A-1. Sphere Structure
#    https://developer.rhino3d.com/api/RhinoCommon/html/T_Rhino_Geometry_Sphere.htm


# A-2. Sphere constructor
#    https://developer.rhino3d.com/api/RhinoCommon/html/Overload_Rhino_Geometry_Sphere__ctor.htm

# type1
#    https://developer.rhino3d.com/api/RhinoCommon/html/M_Rhino_Geometry_Sphere__ctor.htm
plane = rg.Plane.WorldXY
radius = 5
sphere1 = rg.Sphere(plane, radius)

# type2
#    https://developer.rhino3d.com/api/RhinoCommon/html/M_Rhino_Geometry_Sphere__ctor_1.htm
center = rg.Point3d(10, 10, 10)
sphere2 = rg.Sphere(center, radius)


# A-3. Cone properties
#    https://developer.rhino3d.com/api/RhinoCommon/html/Properties_T_Rhino_Geometry_Sphere.htm

'''sphere properties which have same name to the circle/arc/cylinder/cone are skipped ("Center" for ex)'''

# NorthPole/SouthPole
north_pole = sphere1.NorthPole
print('north_pole', type(north_pole), north_pole)


# A-4. Cone methods
#    https://developer.rhino3d.com/api/RhinoCommon/html/Methods_T_Rhino_Geometry_Sphere.htm

'''sphere methods which have same name to the circle/arc/cylinder/cone/box are skipped ("ClosestPoint" or "ToBrep" for ex)'''

# LatitudeDegrees/Radians or LongitudeDegrees/Radians
latitude = sphere1.LatitudeDegrees(15)
print('latitude', type(latitude), latitude)
# ---------- end sphere ----------

# ----
rectangle3d = GhPythonScript()  # -> out, rect1, rect2, rect3, bbox, center, plane, pt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
# ---------- rectangle3d: Python ----------
__author__ = "trtku"
__version__ = "2021.11.10"

'''
This is a basic documentation about Rectangle3d structure in Rhino.Geometry
'''

import Rhino.Geometry as rg


# 0. First of all, there are two different types of representation in rhinocommon: one is class and another one is structure.
#    Transform is belong to Structure in rhinocommon
#    Basically, structure is memory efficient. See source below if you are curious.
#    https://www.grasshopper3d.com/forum/topics/rhinocommon-structure-types


# 1. Rectangle3d Structure
#    https://developer.rhino3d.com/api/RhinoCommon/html/T_Rhino_Geometry_Rectangle3d.htm


# 2. Rectangle3d constructor
#    https://developer.rhino3d.com/api/RhinoCommon/html/Overload_Rhino_Geometry_Rectangle3d__ctor.htm

# 2-1. Interval constructor type1
plane = rg.Plane.WorldXY
interval_a = rg.Interval(-5, 10)
interval_b = rg.Interval(-15, 20)
rect1 = rg.Rectangle3d(plane, interval_a, interval_b)
print('rect1', type(rect1), rect1)

# 2-1. Interval constructor type2
pt_a = rg.Point3d(-5, 10, 15)
pt_b = rg.Point3d(-15, 20, 25)
rect2 = rg.Rectangle3d(plane, pt_a, pt_b)
print('rect2', type(rect2), rect2)

# 2-1. Interval constructor type3
width = 10
height = 20
rect3 = rg.Rectangle3d(plane, width, height)
print('rect3', type(rect3), rect3)


# 3. Rectangle3d properties
#    https://developer.rhino3d.com/api/RhinoCommon/html/Properties_T_Rhino_Geometry_Rectangle3d.htm

# Area
area = rect1.Area
print('area', type(area), area)

# BoundingBox
bbox = rect1.BoundingBox
print('bbox', type(bbox), bbox)

# Center
center = rect1.Center
print('center', type(center), center)

# Circumference
circumference = rect1.Circumference
print('circumerence', type(circumference), circumference)

# Height
height = rect1.Height
print('height', type(height), height)

# Plane
plane = rect1.Plane
print('plane', type(plane), plane)

# Width
width = rect1.Width
print('width', type(width), width)

# X/Y
x = rect1.X
print('x', type(x), x)


# 4. Rectangle3d methods
#    https://developer.rhino3d.com/api/RhinoCommon/html/Methods_T_Rhino_Geometry_Rectangle3d.htm

# ClosestPoint
pt = rg.Point3d.Origin
closest_pt = rect1.ClosestPoint(pt)
print('closest_pt', type(closest_pt), closest_pt)

# Contains
contains = rect1.Contains(pt)
print('contains', type(contains), contains)

# Corner
corner = rect1.Corner(0)
print('corner', type(corner), corner)

# RecenterPlane
rect = rect1.Clone()
rect.RecenterPlane(0)
print('rect', rect==rect1)

# ToNurbsCurve
nurbs = rect1.ToNurbsCurve()
print('nurbs', type(nurbs), nurbs)

# ToPolyline
poly = rect1.ToPolyline()
print('poly', type(poly), poly)
# ---------- end rectangle3d ----------
torus = GhPythonScript()  # -> out, torus
# ---------- torus: Python ----------
__author__ = "trtku"
__version__ = "2021.11.10"

'''
This is a basic documentation about Torus structure in Rhino.Geometry
'''

import Rhino.Geometry as rg


# 0. First of all, there are two different types of representation in rhinocommon: one is class and another one is structure.
#    Transform is belong to Structure in rhinocommon
#    Basically, structure is memory efficient. See source below if you are curious.
#    https://www.grasshopper3d.com/forum/topics/rhinocommon-structure-types

'''I have never used Torus!'''

# A-1. Torus Structure
#    https://developer.rhino3d.com/api/RhinoCommon/html/T_Rhino_Geometry_Torus.htm


# A-2. Torus constructor
#    https://developer.rhino3d.com/api/RhinoCommon/html/M_Rhino_Geometry_Torus__ctor.htm
plane = rg.Plane.WorldXY
major_r = 10
minor_r = 5
torus = rg.Torus(plane, major_r, minor_r)


# A-3. Torus properties
#    https://developer.rhino3d.com/api/RhinoCommon/html/Properties_T_Rhino_Geometry_Cone.htm


# A-4. Tprus methods
#    https://developer.rhino3d.com/api/RhinoCommon/html/Methods_T_Rhino_Geometry_Cone.htm
# ---------- end torus ----------
line = GhPythonScript()  # -> out, line1, line2, line3, bbox, from_pt, line_to_extend, pt, pt_len
# ---------- line: Python ----------
__author__ = "trtku"
__version__ = "2021.11.10"

'''
This is a basic documentation about Line structure in Rhino.Geometry
'''

import Rhino.Geometry as rg


# 0. First of all, there are two different types of representation in rhinocommon: one is class and another one is structure.
#    Transform is belong to Structure in rhinocommon
#    Basically, structure is memory efficient. See source below if you are curious.
#    https://www.grasshopper3d.com/forum/topics/rhinocommon-structure-types


# 1. Line Structure
#    https://developer.rhino3d.com/api/RhinoCommon/html/T_Rhino_Geometry_Line.htm


# 2. Line constructor
#    https://developer.rhino3d.com/api/RhinoCommon/html/Overload_Rhino_Geometry_Line__ctor.htm

# type1
pt_a = rg.Point3d(10, 10, 10)
pt_b = rg.Point3d(-10, -10, -10)
line1 = rg.Line(pt_a, pt_b)
print('line1', type(line1), line1)

# type2
dir = rg.Vector3d(0, 0, 1)
line2 = rg.Line(pt_a, dir)
print('line2', type(line2), line2)

# type3
length = 25
line3 = rg.Line(pt_a, dir, length)
print('line3', type(line3), line3)


# 3. Line properties
#    https://developer.rhino3d.com/api/RhinoCommon/html/Properties_T_Rhino_Geometry_Line.htm

# BoundingBox
bbox = line1.BoundingBox
print('bbox', type(bbox), bbox)

# Direction
dir = line1.Direction
print('dir', type(dir), dir)

# From/X/Y/Z, To/X/Y/Z
from_pt = line1.From
print('from_pt', type(from_pt), from_pt)

# Length
length = line1.Length
print('length', type(length), length)

# UnitTangend
tan = line1.UnitTangent
print('tan', type(tan), tan)


# 4. Line methods
#    https://developer.rhino3d.com/api/RhinoCommon/html/Methods_T_Rhino_Geometry_Line.htm

'''line methods which have same name to the Rectangle3d are skipped ("ClosestPoint" for ex)'''

# Extend
line_to_extend = line1.Clone()
start_length = 20
end_length = 10
line_to_extend.Extend(start_length, end_length)

# Extend
line_to_flip = line1.Clone()
line_to_flip.Flip()
dir_flip = line_to_flip.Direction
print('flip', dir==dir_flip)

# PointAt
param = 0.5
pt = line1.PointAt(param)
print('pt', type(pt), pt)

# PointAtLength
length = 10
pt_len = line1.PointAtLength(length)
print('pt_len', type(pt_len), pt_len)
# ---------- end line ----------
triangle3d = GhPythonScript()  # -> out, tri, mesh
# ---------- triangle3d: Python ----------
__author__ = "trtku"
__version__ = "2021.11.10"

'''
This is a basic documentation about Triangle3d structure in Rhino.Geometry
'''

import Rhino.Geometry as rg



'''Triangle3d is barely used. Therefore, only a few tips are introduced'''


# 0. First of all, there are two different types of representation in rhinocommon: one is class and another one is structure.
#    Transform is belong to Structure in rhinocommon
#    Basically, structure is memory efficient. See source below if you are curious.
#    https://www.grasshopper3d.com/forum/topics/rhinocommon-structure-types


# 1. Triangle3d Structure
#    https://developer.rhino3d.com/api/RhinoCommon/html/T_Rhino_Geometry_Triangle3d.htm


# 2. Triangle3d constructor
#    https://developer.rhino3d.com/api/RhinoCommon/html/M_Rhino_Geometry_Triangle3d__ctor.htm
pt_a = rg.Point3d(10, 10, 10)
pt_b = rg.Point3d(-10, -10, -10)
pt_c = rg.Point3d(10, -10, 0)
tri = rg.Triangle3d(pt_a, pt_b, pt_c)
print('tri', type(tri), tri)


# 3. Triangle3d properties
#    https://developer.rhino3d.com/api/RhinoCommon/html/Properties_T_Rhino_Geometry_Triangle3d.htm


# 4. Triangle3d methods

# 4-1. ToMesh
mesh = tri.ToMesh()
print('mesh', type(mesh), mesh)
# ---------- end triangle3d ----------
