# Grasshopper definition 03_Class_Curve.ghx (Grasshopper 1.0.7)

crv = Curve(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)
crv_2 = Curve(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)
crv_3 = Curve(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)
crv_4 = Curve(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)
pt = Point([Point(2.145225987, 3.464575285, 0), Point(17.05391266, 3.637671366, 0), Point(3.481948584, 13.65286991, 0), Point(13.07247531, 16.73642947, 0)])
crv_5 = Curve(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)
crv_6 = Curve(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)
crv_7 = Curve(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)
crv_8 = Curve(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)
pt_2 = Point([Point(2.145225987, 3.464575285, 0), Point(17.05391266, 3.637671366, 0), Point(3.481948584, 13.65286991, 0), Point(13.07247531, 16.73642947, 0)])
pt_3 = Point([Point(2.145225987, 3.464575285, 0), Point(17.05391266, 3.637671366, 0), Point(3.481948584, 13.65286991, 0), Point(13.07247531, 16.73642947, 0)])
curve = GhPythonScript(crv_a=crv, crv_b=crv_2, crv_c=crv_3, crv_d=crv_4, ctrl_pts=pt, crv_e=crv_5, crv_f=crv_6)  # -> out, c1, c2, c3, c4, c5, c6, c7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; inputs crv_a: Curve, crv_b: Curve, crv_c: Curve, crv_d: Curve, ctrl_pts: list of Point3d, crv_e: Curve, crv_f: Curve
# ---------- curve: Python ----------
__author__ = "trtku"
__version__ = "2021.11.09"

'''
This is a basic documentation about Curve class in Rhino.Geometry
'''

import Rhino.Geometry as rg



# 0. First of all, there are two different types of representation in rhinocommon: one is class and another one is structure.
#    Basically, structure is memory efficient. See source below if you are curious.
#    https://www.grasshopper3d.com/forum/topics/rhinocommon-structure-types



# 1. Curve Class
#    https://developer.rhino3d.com/api/RhinoCommon/html/T_Rhino_Geometry_Curve.htm



# 2. Curve constructor
#    https://developer.rhino3d.com/api/RhinoCommon/html/M_Rhino_Geometry_Curve__ctor.htm
'''Practically, Curve class does not have a constructor. Need to use create methods'''



# 3. Curve methods
#    https://developer.rhino3d.com/api/RhinoCommon/html/Methods_T_Rhino_Geometry_Curve.htm
'''I skipped similar methods to structure like ClosestPoint (see 02_Structure_Primitives.ghx)'''
'''I skipped barely used methods as well'''

'''create methods'''
# CreateArcBlend
start_pt = rg.Point3d(0, 0, 0)
start_dir = rg.Vector3d(0, 1, 0)
end_pt = rg.Point3d(-10, -10, 0)
end_dir = rg.Vector3d(1, 0, 0)
ratio = 1.
c1 = rg.Curve.CreateArcBlend(start_pt, start_dir, end_pt, end_dir, ratio)
print('c1', type(c1), c1)


# CreateArcLineArcBlend
radius = 5
c2 = rg.Curve.CreateArcLineArcBlend(start_pt, start_dir, end_pt, end_dir, radius)
print('c2', type(c2), c2)


# CreateBlendCurve
blend_continuity = rg.BlendContinuity(1)
c3 = rg.Curve.CreateBlendCurve(crv_a, crv_b, blend_continuity)
print('c3', type(c3), c3)


# CreateBoolean series
# get minimum tolerance
import Rhino.RhinoMath as rm
tol = rm.ZeroTolerance
print('tol', type(tol), tol)
c4 = rg.Curve.CreateBooleanDifference(crv_c, crv_d, tol)
print('c4', type(c4), c4)

c5 = rg.Curve.CreateBooleanIntersection(crv_c, crv_d, tol)
print('c5', type(c5), c5)

c6 = rg.Curve.CreateBooleanUnion([crv_c, crv_d], tol)
print('c6', type(c6), c6)


# CreateControlPointCurve
c7 = rg.Curve.CreateControlPointCurve(ctrl_pts, 1)
print('c7', type(c7), c7)
c8 = rg.Curve.CreateControlPointCurve(ctrl_pts, 2)
print('c8', type(c8), c8)
c9 = rg.Curve.CreateControlPointCurve(ctrl_pts, 3)
print('c9', type(c9), c9)


# CreateInterpolatedCurve
c10 = rg.Curve.CreateInterpolatedCurve(ctrl_pts, 3)
print('c10', type(c10), c10)


# CreateFilletCornersCurve
radius = 1
angle_tol = rm.DefaultAngleTolerance
c11 = rg.Curve.CreateFilletCornersCurve(c7, radius, tol, angle_tol)


# CreateTweenCurves
num = 10
c12 = rg.Curve.CreateTweenCurves(crv_a, crv_b, num, tol)
print('c12', type(c12), c12)


'''division methods'''
start = rg.Point3d.Origin
end = rg.Point3d(0, 50, 0)
interval = 2
contour_pts = c9.DivideAsContour(start, end, interval)
print('contour_pts', type(contour_pts), contour_pts)

cnt = 5
include_end = False
cnt_division_params = c9.DivideByCount(cnt, include_end)
print('cnt_division_params', type(cnt_division_params), cnt_division_params)
# how to get ponits
cnt_division_pts = [c9.PointAt(p) for p in cnt_division_params]
print('cnt_division_pts', type(cnt_division_pts), cnt_division_pts)

length = 5
len_division_params = c9.DivideByLength(length, include_end)
# how to get ponits
len_division_pts = [c9.PointAt(p) for p in len_division_params]
print('len_division_pts', type(len_division_pts), len_division_pts)

dist = 5
dist_division_pts = c9.DivideEquidistant(dist)
print('dist_division_pts', type(dist_division_pts), dist_division_pts)


'''other methods'''
# Duplicate
crv_copy = c9.Duplicate()


'''analysis methods'''
# CurvatureAt
param = 0.5
curvature = crv_copy.CurvatureAt(param)
print('curvature', type(curvature), curvature)


# DerivativeAt
Nth = 1
derivative = crv_copy.DerivativeAt(param, Nth)
print('derivative', type(derivative), derivative)


# PointAt
pt = crv_copy.PointAt(0.5)
print('pt', type(pt), pt)


# PointAtLength
pt_length = crv_copy.PointAtLength(10)
print('pt_length', type(pt_length), pt_length)


# FrameAt
results = crv_copy.FrameAt(0.25)
success = results[0]
frame = results[1]
print('success', type(success), success)
print('frame', type(frame), frame)


# PerpendicularFrameAt
results = crv_copy.PerpendicularFrameAt(0.75)
success = results[0]
frame_perpendicular = results[1]
print('frame_perpendicular', type(frame_perpendicular), frame_perpendicular)


# TangnetAt
tan = crv_copy.TangentAt(1.0)
print('tan', type(tan), tan)


# Get Series
plane = rg.Plane.WorldXY
bbox = crv_copy.GetBoundingBox(plane)
print('bbox', type(bbox), bbox)

length = crv_copy.GetLength(1.0)
print('lenght', type(length), length)

params = [((1/10) * i) for i in range(10)]
frames = crv_copy.GetPerpendicularFrames(params)
print('frames', type(frames), frames)


# InflectionPoints
#    https://developer.rhino3d.com/api/RhinoCommon/html/M_Rhino_Geometry_Curve_InflectionPoints.htm
inflection_pts = crv_copy.InflectionPoints()
print('inflection_pts', type(inflection_pts), inflection_pts)


# MaxCurvaturePoints
max_curvature_pts = crv_copy.MaxCurvaturePoints()
print('max_curvature_pts', type(max_curvature_pts), max_curvature_pts)


# Is series
is_arc = crv_copy.IsArc(rm.ZeroTolerance)
print('is_arc', type(is_arc), is_arc)

is_circle = crv_copy.IsCircle(rm.ZeroTolerance)
print('is_circle', type(is_circle), is_circle)

is_continuous = crv_copy.IsContinuous(rg.Continuity.C0_continuous, rm.ZeroTolerance)
print('is_continuous', type(is_continuous), is_continuous)

is_ellipse = crv_copy.IsEllipse(rm.ZeroTolerance)
print('is_ellipse', type(is_ellipse), is_ellipse)

is_inplane = crv_copy.IsInPlane(rg.Plane.WorldXY, rm.ZeroTolerance)
print('is_inplane', type(is_inplane), is_inplane)

is_linear = crv_copy.IsLinear(rm.ZeroTolerance)
print('is_linear', type(is_linear), is_linear)

is_planar = crv_copy.IsPlanar(rm.ZeroTolerance)
print('is_planar', type(is_planar), is_planar)

is_polyline = crv_copy.IsPolyline()
print('is_polyline', type(is_polyline), is_polyline)

is_short = crv_copy.IsShort(rm.ZeroTolerance, rg.Interval(0,0.1))
print('is_short', type(is_short), is_short)


# LengthParameter
param = crv_copy.LengthParameter(10)
print('param', type(param), param)


'''edit methods'''
# JoinCurves
joined_crv = rg.Curve.JoinCurves([crv_e, crv_f])
print('joined_crv', type(joined_crv), joined_crv)


# Extend
extended = crv_copy.Extend(rg.CurveEnd.Both, 50, rg.CurveExtensionStyle.Line)
print('extended', type(extended), extended)


# Offset
offset = crv_copy.Offset(rg.Plane.WorldXY, 3, rm.ZeroTolerance, rg.CurveOffsetCornerStyle.Smooth)
print('offset', type(offset), offset)

# Fit
fit = crv_copy.Fit(3, rm.ZeroTolerance, rm.DefaultAngleTolerance)
print('fit', type(fit), fit)


# Project series
projection = rg.Curve.ProjectToPlane(crv_copy, rg.Plane.WorldZX)
print('projection', type(projection), projection)


# Rebuild
pt_cnt = 3
degree = 1
preserve_tan = False
nurbs_rebult = crv_copy.Rebuild(pt_cnt, degree, preserve_tan)


# Reverse
crv_copy_reversed = crv_copy.Duplicate()
crv_copy_reversed.Reverse()
print('reversed start points', crv_copy.PointAtStart==crv_copy_reversed.PointAtStart)
print('crv_copy_reversed', type(crv_copy_reversed), crv_copy_reversed)


# Smooth
smoothFactor = 10
bXSmooth = True
bYSmooth = True
bZSmooth = True
bFixBoundaries = True
coordinateSystem = rg.SmoothingCoordinateSystem.World
plane = rg.Plane.WorldXY
smooth = crv_copy.Smooth(smoothFactor, bXSmooth, bYSmooth, bZSmooth, bFixBoundaries, coordinateSystem, plane)
print('smooth', type(smooth), smooth)


# Split
ts = [((1/10) * i) for i in range(10)]
splits = crv_copy.Split(ts)


# Trim
length = 10
trimmed = crv_copy.Trim(rg.CurveEnd.Start, length)
print('trimmed', type(trimmed), trimmed)


'''convert methods'''
# To series
tol = rm.ZeroTolerance
angle_tol = rm.DefaultAngleTolerance
min_len = 1
max_len = 5
arcs_lines = crv_copy.ToArcsAndLines(tol, angle_tol, min_len, max_len)
print('arcs_lines', type(arcs_lines), arcs_lines)

nurbs = crv_copy.ToNurbsCurve()

polyline = crv_copy.ToPolyline(rm.ZeroTolerance, rm.DefaultAngleTolerance, 1, 5)



# 4. Curve properties
#    https://developer.rhino3d.com/api/RhinoCommon/html/Properties_T_Rhino_Geometry_Curve.htm
'''I skipped same name properties to structure (see 02_Structure_Primitives.ghx)'''

# Degree
degree = crv_copy.Degree
print('degree', type(degree), degree)

# Dimension
dimension = crv_copy.Dimension
print('dimension', type(dimension), dimension)

# Domain
domain = crv_copy.Domain
print('domain', type(domain), domain)

# IsClosed
is_closed = crv_copy.IsClosed
print('is_closed', type(is_closed), is_closed)

# IsPeriodic
is_peri = crv_copy.IsPeriodic
print('is_peri', type(is_peri), is_peri)

# PointAtEnd/Start, TangentAtEnd/Start
start_pt = crv_copy.PointAtEnd
print('start_pt', type(start_pt), start_pt)
# ---------- end curve ----------
arccurve = GhPythonScript()  # -> out, ac1, ac2, ac3, ac4
# ---------- arccurve: Python ----------
__author__ = "trtku"
__version__ = "2021.11.09"

'''
This is a basic documentation about ArcCurve class in Rhino.Geometry
'''

import Rhino.Geometry as rg



# 0. First of all, there are two different types of representation in rhinocommon: one is class and another one is structure.
#    Basically, structure is memory efficient. See source below if you are curious.
#    https://www.grasshopper3d.com/forum/topics/rhinocommon-structure-types



# 1. ArcCurve Class
#    https://developer.rhino3d.com/api/RhinoCommon/html/T_Rhino_Geometry_ArcCurve.htm



# 2. ArcCurve constructor
#    https://developer.rhino3d.com/api/RhinoCommon/html/Overload_Rhino_Geometry_ArcCurve__ctor.htm
import math as m
arc = rg.Arc(rg.Plane.WorldXY, 10, m.pi)
ci = rg.Circle(15)

# 2-1. constructor type1
ac1 = rg.ArcCurve(arc)

# 2-2. constructor type2
ac2 = rg.ArcCurve(arc, 0.5, 0.75)

# 2-3. constructor type3
ac3 = rg.ArcCurve(ci)

# 2-4. constructor type4
ac4 = rg.ArcCurve(ci, 0.5, 0.75)



# 3. ArcCurve properties
#    https://developer.rhino3d.com/api/RhinoCommon/html/Properties_T_Rhino_Geometry_ArcCurve.htm
'''I skipped same name properties to Arc structure (see 02_Structure_Primitives.ghx)'''
'''I skipped same name properties to Curve class (see Curve class)'''



# 4. ArcCurve methods
#    https://developer.rhino3d.com/api/RhinoCommon/html/Methods_T_Rhino_Geometry_ArcCurve.htm
'''I skipped similar methods to Arc structure like ClosestPoint (see 02_Structure_Primitives.ghx)'''
'''I skipped same name properties to Curve class (see Curve class)'''
# ---------- end arccurve ----------
linecurve = GhPythonScript()  # -> out, start, end, li
# ---------- linecurve: Python ----------
__author__ = "trtku"
__version__ = "2021.11.09"

'''
This is a basic documentation about LineCurve class in Rhino.Geometry
'''

import Rhino.Geometry as rg



# 0. First of all, there are two different types of representation in rhinocommon: one is class and another one is structure.
#    Basically, structure is memory efficient. See source below if you are curious.
#    https://www.grasshopper3d.com/forum/topics/rhinocommon-structure-types



# 1. LineCurve Class
#    https://developer.rhino3d.com/api/RhinoCommon/html/T_Rhino_Geometry_LineCurve.htm



# 2. LineCurve constructor
#    https://developer.rhino3d.com/api/RhinoCommon/html/Overload_Rhino_Geometry_LineCurve__ctor.htm
start = rg.Point3d(0, 0, 0)
end = rg.Point3d(10, -10, 0)
li = rg.LineCurve(start, end)



# 3. LineCurve properties
#    https://developer.rhino3d.com/api/RhinoCommon/html/Properties_T_Rhino_Geometry_ArcCurve.htm
'''I skipped same name properties to Arc structure (see 02_Structure_Primitives.ghx)'''
'''I skipped same name properties to Curve class (see Curve class)'''



# 4. LineCurve methods
#    https://developer.rhino3d.com/api/RhinoCommon/html/Methods_T_Rhino_Geometry_LineCurve.htm
'''I skipped similar methods to Arc structure, like ClosestPoint (see 02_Structure_Primitives.ghx)'''
'''I skipped same name properties to Curve class (see Curve class)'''
# ---------- end linecurve ----------
nurbscurve = GhPythonScript(nurbs=crv_7)  # -> out, nurbs, ctrl_pts, nurbs1, h_spline, parabola; inputs nurbs: Curve
# ---------- nurbscurve: Python ----------
__author__ = "trtku"
__version__ = "2021.11.09"

'''
This is a basic documentation about NurbsCurve class in Rhino.Geometry
'''

import Rhino.Geometry as rg



# 0. First of all, there are two different types of representation in rhinocommon: one is class and another one is structure.
#    Basically, structure is memory efficient. See source below if you are curious.
#    https://www.grasshopper3d.com/forum/topics/rhinocommon-structure-types



# 1. NurbsCurve Class
#    https://developer.rhino3d.com/api/RhinoCommon/html/T_Rhino_Geometry_NurbsCurve.htm



# 2. NurbsCurve constructor
#    https://developer.rhino3d.com/api/RhinoCommon/html/Overload_Rhino_Geometry_NurbsCurve__ctor.htm
degree = 3
pointcount = 5
nurbs_invalid = rg.NurbsCurve(degree, pointcount)


# 3. NurbsCurve properties
#    https://developer.rhino3d.com/api/RhinoCommon/html/Properties_T_Rhino_Geometry_NurbsCurve.htm
'''I skipped same name properties to Arc structure (see 02_Structure_Primitives.ghx)'''
'''I skipped same name properties to Curve class (see Curve class)'''

# IsRational
rational = nurbs.IsRational
print('rational', type(rational), rational)

# Knots
knots = nurbs.Knots
print('knots', type(knots), knots)

# Points
ctrl_pts_collection = nurbs.Points
print('ctrl_pts_collection', type(ctrl_pts_collection), ctrl_pts_collection)
ctrl_pts = [ctrl_pts_collection.Item[i].Location for i in range(ctrl_pts_collection.Count)]
print('ctrl_pts', type(ctrl_pts), ctrl_pts)
#ctrl_pts = [cp.Location for cp in ctrl_pts_obj]

# 4. NurbsCurve methods
#    https://developer.rhino3d.com/api/RhinoCommon/html/Methods_T_Rhino_Geometry_NurbsCurve.htm
'''I skipped similar methods to Arc structure, like ClosestPoint (see 02_Structure_Primitives.ghx)'''
'''I skipped same name properties to Curve class (see Curve class)'''

'''create methods'''
periodic = False
degree = 3
points = [rg.Point3d(i, i%2, 0) for i in range(10)]
nurbs1 = rg.NurbsCurve.Create(periodic, degree, points)

start_tan = rg.Vector3d.XAxis
end_tan = rg.Vector3d.YAxis
h_spline = rg.NurbsCurve.CreateHSpline(points, start_tan, end_tan)

focus = rg.Point3d(5, 5, 0)
start = rg.Point3d(0, 0, 0)
end = rg.Point3d(10, 10, 0)
parabola = rg.NurbsCurve.CreateParabolaFromFocus(focus, start, end)


'''conversion'''
#rg.NurbsCurve.CreateFromArc(arc, degree, cvCount)
#rg.NurbsCurve.CreateFromCircle(ci, degree, cvCount)
#rg.NurbsCurve.CreateFromEllipse(ellipse)
#rg.NurbsCurve.CreateFromLine(line)


'''edit methods'''
# IncreaseDegree
increased = nurbs.IncreaseDegree(5)
print('increased', type(increased), increased)


# Reparametarize
reparametarized = nurbs.Reparameterize(0)
print('reparametarized', type(reparametarized), reparametarized)


'''analysis methods'''
# UVNDirectionsAt
uvn_direction = nurbs.UVNDirectionsAt(0.5)
print('uvn_direction', type(uvn_direction), uvn_direction)
# ---------- end nurbscurve ----------
polycurve = GhPythonScript(poly_crv=crv_8)  # -> out, explosion, segment; inputs poly_crv: Curve
# ---------- polycurve: Python ----------
__author__ = "trtku"
__version__ = "2021.11.09"

'''
This is a basic documentation about PolyCurve class in Rhino.Geometry
'''

import Rhino.Geometry as rg



# 0. First of all, there are two different types of representation in rhinocommon: one is class and another one is structure.
#    Basically, structure is memory efficient. See source below if you are curious.
#    https://www.grasshopper3d.com/forum/topics/rhinocommon-structure-types



# 1. PolyCurve Class
#    https://developer.rhino3d.com/api/RhinoCommon/html/T_Rhino_Geometry_PolyCurve.htm



# 2. PolyCurve constructor
#    https://developer.rhino3d.com/api/RhinoCommon/html/Overload_Rhino_Geometry_PolyCurve__ctor.htm



# 3. PolyCurve properties
#    https://developer.rhino3d.com/api/RhinoCommon/html/Properties_T_Rhino_Geometry_PolyCurve.htm
'''I skipped same name properties to Arc structure (see 02_Structure_Primitives.ghx)'''
'''I skipped same name properties to Curve class (see Curve class)'''

# SegmentCount
segment_cnt = poly_crv.SegmentCount
print('segment_cnt', type(segment_cnt), segment_cnt)


# 4. PolyCurve methods
#    https://developer.rhino3d.com/api/RhinoCommon/html/Methods_T_Rhino_Geometry_PolyCurve.htm
'''I skipped similar methods to Arc structure, like ClosestPoint (see 02_Structure_Primitives.ghx)'''
'''I skipped same name properties to Curve class (see Curve class)'''

'''edit methods'''
# Explode
explosion = poly_crv.Explode()
print('explosion', type(explosion), explosion)

# SegmentCurve
segment = poly_crv.SegmentCurve(4)
print('segment', type(segment), segment)
# ---------- end polycurve ----------
polylinecurve = GhPythonScript()  # -> out, pts, polyline
# ---------- polylinecurve: Python ----------
__author__ = "trtku"
__version__ = "2021.11.09"

'''
This is a basic documentation about PolylineCurve class in Rhino.Geometry
'''

import Rhino.Geometry as rg



# 0. First of all, there are two different types of representation in rhinocommon: one is class and another one is structure.
#    Basically, structure is memory efficient. See source below if you are curious.
#    https://www.grasshopper3d.com/forum/topics/rhinocommon-structure-types



# 1. PolylineCurve Class
#    https://developer.rhino3d.com/api/RhinoCommon/html/T_Rhino_Geometry_PolylineCurve.htm



# 2. PolylineCurve constructor
#    https://developer.rhino3d.com/api/RhinoCommon/html/Overload_Rhino_Geometry_PolylineCurve__ctor.htm
pts = [rg.Point3d(i, i%2, 0) for i in range(10)]
polyline = rg.PolylineCurve(pts)



# 3. PolylineCurve properties
#    https://developer.rhino3d.com/api/RhinoCommon/html/Properties_T_Rhino_Geometry_PolylineCurve.htm
'''I skipped same name properties to Arc structure (see 02_Structure_Primitives.ghx)'''
'''I skipped same name properties to Curve class (see Curve class)'''


# 4. PolylineCurve methods
#    https://developer.rhino3d.com/api/RhinoCommon/html/Methods_T_Rhino_Geometry_PolylineCurve.htm
'''I skipped similar methods to Arc structure, like ClosestPoint (see 02_Structure_Primitives.ghx)'''
'''I skipped same name properties to Curve class (see Curve class)'''
# ---------- end polylinecurve ----------
beziercurve = GhPythonScript(pts=pt_2)  # -> out, bezier, nurbs, bezier1, nurbs1, vertices; inputs pts: list of Point3d
# ---------- beziercurve: Python ----------
__author__ = "trtku"
__version__ = "2021.11.09"

'''
This is a basic documentation about BezierCurve class in Rhino.Geometry
'''

import Rhino.Geometry as rg



# 0. First of all, there are two different types of representation in rhinocommon: one is class and another one is structure.
#    Basically, structure is memory efficient. See source below if you are curious.
#    https://www.grasshopper3d.com/forum/topics/rhinocommon-structure-types


# 1. BezierCurve Class
#    https://developer.rhino3d.com/api/RhinoCommon/html/T_Rhino_Geometry_BezierCurve.htm

'''as an exception, the bezier curve is not derived from Curve.'''


# 2. BezierCurve constructor
#    https://developer.rhino3d.com/api/RhinoCommon/html/Overload_Rhino_Geometry_BezierCurve__ctor.htm

# create IEnumerable list
# why and what is IEnumerable? see below
#    https://discourse.mcneel.com/t/ghpython-what-is-ienumerable-int-edgeindices/93319
from System import Array
IElist = Array[rg.Point3d](pts)
# construct bezier object
bezier = rg.BezierCurve(IElist)
print('bezier', type(bezier), bezier)
# convert bezier object in to nurbs because there is no bezier curve type in grasshopper.
nurbs = bezier.ToNurbsCurve()
print('nurbs', type(nurbs), nurbs)



# 3. BezierCurve properties
#    https://developer.rhino3d.com/api/RhinoCommon/html/Properties_T_Rhino_Geometry_BezierCurve.htm

# ControlVertexCount
ctrl_v_cnt = bezier.ControlVertexCount
print('ctrl_v_cnt', type(ctrl_v_cnt), ctrl_v_cnt)


# 4. BezierCurve methods
#    https://developer.rhino3d.com/api/RhinoCommon/html/Methods_T_Rhino_Geometry_BezierCurve.htm

'''create methods'''
bezier1 = rg.BezierCurve.CreateLoftedBezier(IElist)
nurbs1 = bezier1.ToNurbsCurve()


vertices = [bezier.GetControlVertex3d(i) for i in range(ctrl_v_cnt)]
# ---------- end beziercurve ----------
polyline = GhPythonScript(pts=pt_3)  # -> out, pl, plc, bbox, plc1, plc2, plc3, center; inputs pts: list of Point3d
# ---------- polyline: Python ----------
__author__ = "trtku"
__version__ = "2021.11.09"

'''
This is a basic documentation about Polyline class in Rhino.Geometry
'''

import Rhino.Geometry as rg



# 0. First of all, there are two different types of representation in rhinocommon: one is class and another one is structure.
#    Basically, structure is memory efficient. See source below if you are curious.
#    https://www.grasshopper3d.com/forum/topics/rhinocommon-structure-types


# 1. Polyline Class
#    https://developer.rhino3d.com/api/RhinoCommon/html/T_Rhino_Geometry_Polyline.htm



# 2. Polyline constructor
#    https://developer.rhino3d.com/api/RhinoCommon/html/Overload_Rhino_Geometry_Polyline__ctor.htm

# construct bezier object
pl = rg.Polyline(pts)
print('pl', type(pl), pl)
# convert bezier object in to PolylineCurve because there is no bezier curve type in grasshopper.
plc = pl.ToPolylineCurve()
print('plc', type(plc), plc)



# 3. Polyline properties
#    https://developer.rhino3d.com/api/RhinoCommon/html/Properties_T_Rhino_Geometry_Polyline.htm

bbox = pl.BoundingBox
print('bbox', type(bbox), bbox)



# 4. Polyline methods
#    https://developer.rhino3d.com/api/RhinoCommon/html/Methods_T_Rhino_Geometry_Polyline.htm

'''create methods'''
# CreateCircumscribedPolygon
ci = rg.Circle(10)
cnt = 6
pl1 = rg.Polyline.CreateCircumscribedPolygon(ci, cnt)
plc1 = pl1.ToPolylineCurve()

# CreateInscribedPolygon
pl2 = rg.Polyline.CreateInscribedPolygon(ci, cnt)
plc2 = pl2.ToPolylineCurve()

# CreateStarPolygon
pl3 = rg.Polyline.CreateStarPolygon(ci, 5, cnt)
plc3 = pl3.ToPolylineCurve()

'''edit methods'''
# ReduceSegments
cnt = pl.ReduceSegments(0.01)
print('cnt', type(cnt), cnt)

'''analysis methods'''
# CenterPoint
center = pl.CenterPoint()
print('center', type(center), center)
# ---------- end polyline ----------
crv_9 = Curve(curve.c1)
crv_10 = Curve(curve.c2)
crv_11 = Curve(curve.c3)
crv_12 = Curve(curve.c4)
crv_13 = Curve(curve.c5)
crv_14 = Curve(curve.c6)
crv_15 = Curve(curve.c7)
crv_16 = Curve(curve.c8)
crv_17 = Curve(curve.c9)
crv_18 = Curve(curve.c10)
crv_19 = Curve(curve.c11)
crv_20 = Curve(curve.c12)
pt_4 = Point(curve.contour_pts)
pt_5 = Point(curve.cnt_division_pts)
pt_6 = Point(curve.len_division_pts)
pt_7 = Point(curve.dist_division_pts)
pt_8 = Point(curve.pt)
pt_9 = Point(curve.pt_length)
pln = Plane(curve.frame)
pln_2 = Plane(curve.frame_perpendicular)
box = Box(curve.bbox)
pln_3 = Plane(curve.frames)
pt_10 = Point(curve.inflection_pts)
pt_11 = Point(curve.max_curvature_pts)
crv_21 = Curve(curve.joined_crv)
crv_22 = Curve(curve.extended)
crv_23 = Curve(curve.offset)
crv_24 = Curve(curve.fit)
crv_25 = Curve(curve.projection)
crv_26 = Curve(curve.nurbs_rebult)
crv_27 = Curve(curve.crv_copy_reversed)
crv_28 = Curve(curve.smooth)
crv_29 = Curve(curve.splits)
crv_30 = Curve(curve.trimmed)
crv_31 = Curve(curve.arcs_lines)
crv_32 = Curve(curve.nurbs)
crv_33 = Curve(curve.polyline)
crv_34 = Curve(arccurve.ac1)
crv_35 = Curve(arccurve.ac2)
crv_36 = Curve(arccurve.ac3)
crv_37 = Curve(arccurve.ac4)
pt_12 = Point(linecurve.start)
pt_13 = Point(linecurve.end)
line = Line(linecurve.li)
crv_38 = Curve(nurbscurve.nurbs)
pt_14 = Point(nurbscurve.ctrl_pts)
crv_39 = Curve(nurbscurve.nurbs1)
crv_40 = Curve(nurbscurve.h_spline)
crv_41 = Curve(nurbscurve.parabola)
crv_42 = Curve(polycurve.explosion)
crv_43 = Curve(polycurve.segment)
pt_15 = Point(polylinecurve.pts)
crv_44 = Curve(polylinecurve.polyline)
crv_45 = Curve(beziercurve.bezier)
crv_46 = Curve(beziercurve.nurbs)
crv_47 = Curve(beziercurve.bezier1)
crv_48 = Curve(beziercurve.nurbs1)
pt_16 = Point(beziercurve.vertices)
crv_49 = Curve(polyline.pl)
crv_50 = Curve(polyline.plc)
box_2 = Box(polyline.bbox)
crv_51 = Curve(polyline.plc1)
crv_52 = Curve(polyline.plc2)
crv_53 = Curve(polyline.plc3)
pt_17 = Point(polyline.center)
