# Grasshopper definition 04_Class_Surface.ghx (Grasshopper 1.0.7)

srf = Surface(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)
crvs = Curve([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])
srf_2 = Surface(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)
crv = Curve(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)
srf_3 = Surface(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)
panel = Panel("Surface class")
surface = GhPythonScript(crv1=crv, input_srf1=srf_3, input_srf2=srf)  # -> out, srf1, srf2, srf3, srf4, n, pt, uvpt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; inputs crv1: Curve, input_srf1: Surface, input_srf2: Surface
# ---------- surface: Python ----------
__author__ = "trtku"
__version__ = "2021.11.09"

'''
This is a basic documentation about Surface class in Rhino.Geometry
'''

import Rhino.Geometry as rg



# 0. First of all, there are two different types of representation in rhinocommon: one is class and another one is structure.
#    Basically, structure is memory efficient. See source below if you are curious.
#    https://www.grasshopper3d.com/forum/topics/rhinocommon-structure-types



# 1. Surface Class
#    https://developer.rhino3d.com/api/RhinoCommon/html/T_Rhino_Geometry_Surface.htm



# 2. Surface constructor
#    https://developer.rhino3d.com/api/RhinoCommon/html/Overload_Rhino_Geometry_Surface__ctor.htm
'''Practically, we dont use Surface constructor. Need to use create methods'''



# 3. Surface methods
#    https://developer.rhino3d.com/api/RhinoCommon/html/Methods_T_Rhino_Geometry_Surface.htm
'''I skipped similar methods to structure like ClosestPoint (see 02_Structure_Primitives.ghx)'''
'''I skipped barely used methods as well'''

'''create methods'''
# CreateExtrusion
height = 20
direction = rg.Vector3d.ZAxis * height
srf1 = rg.Surface.CreateExtrusion(crv1, direction)
print('srf1', type(srf1), srf1)

# CreateExtrusionToPoint
pt = rg.Point3d(25, 50, 50)
srf2 = rg.Surface.CreateExtrusionToPoint(crv1, pt)
print('srf2', type(srf2), srf2)

# CreateRollingBallFillet
import Rhino.RhinoMath as rm
radius = 5
tolerance = rm.ZeroTolerance
srf4 = rg.Surface.CreateRollingBallFillet(input_srf1, input_srf2, radius, tolerance)


'''division methods'''


'''analysis methods'''
# CurvtureAt
u = 0.5
v = 0.5
sc = srf1.CurvatureAt(u, v)
print('sc', type(sc), sc)

# SurfaceCurvature class
print('Gaussian', type(sc.Gaussian), sc.Gaussian)
print('Mean', type(sc.Mean), sc.Mean)
n = sc.Normal
print('Normal', type(n), n)
pt = sc.Point
print('Point', type(pt), pt)
uvpt = sc.UVPoint
print('UVPoint', type(uvpt), uvpt)
#ci = sc.OscularingCircle(0)
ci = sc.OsculatingCircle(0)
print('OsculatingCircle', type(ci), ci)

# Degree
degree = srf1.Degree(0)
print('degree', type(degree), degree)

# Domain
dom = srf1.Domain(0)
print('dom', type(dom), dom)

# Evaluate
Nth = 1
evaluate = srf1.Evaluate(u, v, Nth)
print('evaluate', type(evaluate), evaluate)

# FrameAt
success, frame = srf1.FrameAt(u, v)
print(frame)

# Is series
planar = srf1.IsPlanar()
print('planar', type(planar), planar)

# NormalAt
normal = srf1.NormalAt(u, v,)
print('normal', type(normal), normal)

# PointAt
ptat = srf1.PointAt(u, v)
print('ptat', type(ptat), ptat)

'''edit methods'''
# Rbuild
ud = 1
vd = 1
upt_cnt = 4
vpt_cnt = 6
rebuilt = srf1.Rebuild(ud, vd, upt_cnt, vpt_cnt)

# Smooth
smooth_fact = 0.5
x_smooth = True
y_smooth = True
z_smooth = True
fix_bounds = True
coord = rg.SmoothingCoordinateSystem.World
smooth = srf1.Smooth(smooth_fact, x_smooth, y_smooth, z_smooth, fix_bounds, coord)
print('smooth', type(smooth), smooth)

# Split
split = srf1.Split(1, 12)
split_a, split_b = split
print('split', type(split), split)

# Trim
u_int = rg.Interval(12, 15)
v_int = rg.Interval(12, 25)
trimmed = srf1.Trim(u_int, v_int)
print('trimmed', type(trimmed), trimmed)

'''convert methods'''
# ToBrep
brep = srf1.ToBrep()
print('brep', type(brep), brep)

# ToNurbsSurface
n_srf = srf1.ToNurbsSurface()
print('n_srf', type(n_srf), n_srf)

'''other methods'''
# InterpolatedCurvePmSurface
pts = [srf1.PointAt(i*1.5, i*1.5) for i in range(10)]
int_crv =srf1.InterpolatedCurveOnSurface(pts, tolerance)
print('int_crv', type(int_crv), int_crv)

# IsoCurve
param = 1.0
iso_crv = srf1.IsoCurve(1, param)
print('iso_crv', type(iso_crv), iso_crv)

# ShortPath
sp = srf1.ShortPath(rg.Point2d(pts[0]), rg.Point2d(pts[-1]), tolerance)
print('sp', type(sp), sp)

# 4. Curve properties
#    https://developer.rhino3d.com/api/RhinoCommon/html/Properties_T_Rhino_Geometry_Surface.htm
'''I skipped same name properties to structure (see 02_Structure_Primitives.ghx)'''

# IsSolid
is_solid = srf1.IsSolid
print('is_solid', type(is_solid), is_solid)
# ---------- end surface ----------
nurbssurface = GhPythonScript(crvs=crvs)  # -> out, nurbs1, nurbs2, nurbs3, nurbs4, pts, nurbs5, ctrl_pts; inputs crvs: list of Curve
# ---------- nurbssurface: Python ----------
__author__ = "trtku"
__version__ = "2021.11.09"

'''
This is a basic documentation about NurbsSurface class in Rhino.Geometry
'''

import Rhino.Geometry as rg



# 0. First of all, there are two different types of representation in rhinocommon: one is class and another one is structure.
#    Basically, structure is memory efficient. See source below if you are curious.
#    https://www.grasshopper3d.com/forum/topics/rhinocommon-structure-types



# 1. NurbsSurface Class
#    https://developer.rhino3d.com/api/RhinoCommon/html/T_Rhino_Geometry_NurbsSurface.htm



# 2. NurbsSurface constructor
#    https://developer.rhino3d.com/api/RhinoCommon/html/Overload_Rhino_Geometry_NurbsSurface__ctor.htm
'''Practically, we dont use NurbsSurface constructor in python. Need to use create methods'''



# 3. NurbsSurface methods
#    https://developer.rhino3d.com/api/RhinoCommon/html/Methods_T_Rhino_Geometry_NurbsSurface.htm
'''I skipped similar methods to structure like ClosestPoint (see 02_Structure_Primitives.ghx)'''
'''I skipped barely used methods as well'''

'''create methods'''
# CreateFromCorners
pt1, pt2, pt3, pt4 = rg.Point3d(0, 0, 0), rg.Point3d(10, 0, 5), rg.Point3d(10, 10, 0), rg.Point3d(0, 10, 5)
nurbs2 = rg.NurbsSurface.CreateFromCorners(pt1, pt2, pt3, pt4)
print('nurbs2', type(nurbs2), nurbs2)

# CreateNetworkSurface
import Rhino.RhinoMath as rm
length_tol = rm.ZeroTolerance
angle_tol = rm.DefaultAngleTolerance
nurbs3, _ = rg.NurbsSurface.CreateNetworkSurface(crvs, 0, length_tol, length_tol, angle_tol)
print('nurbs3', type(nurbs3), nurbs3)

# CreateRuledSurface
nurbs4 = rg.NurbsSurface.CreateRuledSurface(crvs[0], crvs[2])
print('nurbs4', type(nurbs4), nurbs4)

# CreateThroughPoints
import random as r
u_cnt = 5
v_cnt = 5
u_degree = 3
v_degree = 3
u_closed = False
v_closed = False

pts = []
for i in range(u_cnt):
    for j in range(v_cnt):
        pt = rg.Point3d(-i*10, -j*10, r.random()*10)
        pts.append(pt)

nurbs5 = rg.NurbsSurface.CreateThroughPoints(pts, u_cnt, v_cnt, u_degree, v_degree, u_closed, v_closed)
print('nurbs5', type(nurbs5), nurbs5)

'''analysis methods'''
dir = nurbs5.UVNDirectionsAt(0.5, 0.5)
print('UVNDirection', type(dir), dir)



# 4. NurbsSurface properties
#    https://developer.rhino3d.com/api/RhinoCommon/html/Properties_T_Rhino_Geometry_Surface.htm
'''I skipped same name properties to structure (see 02_Structure_Primitives.ghx)'''

ctrl_pts = []
nurbs_srf_pts = nurbs5.Points
for i in range(u_cnt):
    for j in range(v_cnt):
        control_pt = nurbs_srf_pts.GetControlPoint(i, j)
        pt = control_pt.Location
        ctrl_pts.append(pt)
# ---------- end nurbssurface ----------
planesurface = GhPythonScript()  # -> out, ps
# ---------- planesurface: Python ----------
__author__ = "trtku"
__version__ = "2021.11.09"

'''
This is a basic documentation about PlaneSurface class in Rhino.Geometry
'''

import Rhino.Geometry as rg



# 0. First of all, there are two different types of representation in rhinocommon: one is class and another one is structure.
#    Basically, structure is memory efficient. See source below if you are curious.
#    https://www.grasshopper3d.com/forum/topics/rhinocommon-structure-types



# 1. PlaneSurface Class
#    https://developer.rhino3d.com/api/RhinoCommon/html/T_Rhino_Geometry_PlaneSurface.htm



# 2. PlaneSurface constructor
#    https://developer.rhino3d.com/api/RhinoCommon/html/Overload_Rhino_Geometry_PlaneSurface__ctor.htm
u_int = rg.Interval(0., 1.)
v_int = rg.Interval(0., 1.)
ps = rg.PlaneSurface(rg.Plane.WorldXY, u_int, v_int)


# 3. PlaneSurface methods
#    https://developer.rhino3d.com/api/RhinoCommon/html/Methods_T_Rhino_Geometry_PlaneSurface.htm
'''most of the methods are inherited'''



# 4. PlaneSurface properties
#    https://developer.rhino3d.com/api/RhinoCommon/html/Properties_T_Rhino_Geometry_PlaneSurface.htm
'''all the properties are inherited'''
# ---------- end planesurface ----------
unroller = GhPythonScript(srf=srf_2)  # -> out, brep, pt3f, pt2d, pt2f, pt4d; inputs srf: Surface
# ---------- unroller: Python ----------
__author__ = "trtku"
__version__ = "2021.11.09"

'''
This is a basic documentation about Unroller class in Rhino.Geometry
'''

import Rhino.Geometry as rg



# 0. First of all, there are two different types of representation in rhinocommon: one is class and another one is structure.
#    Basically, structure is memory efficient. See source below if you are curious.
#    https://www.grasshopper3d.com/forum/topics/rhinocommon-structure-types


# 1. Unroller Class
#    https://developer.rhino3d.com/api/RhinoCommon/html/T_Rhino_Geometry_Unroller.htm

unroller = rg.Unroller(srf)

unrolled = unroller.PerformUnroll()

brep = unrolled[0][0]
# ---------- end unroller ----------
srf_4 = Surface(surface.srf1)
srf_5 = Surface(surface.srf2)
srf_6 = Surface(surface.srf3)
vec = Vector(surface.n)
pt = Point(surface.uvpt)
circle = Circle(surface.ci)
srf_7 = Surface(surface.split_b)
pt_2 = Point(surface.pts)
crv_2 = Curve(surface.int_crv)
crv_3 = Curve(surface.iso_crv)
crv_4 = Curve(surface.sp)
srf_8 = Surface(nurbssurface.nurbs1)
srf_9 = Surface(nurbssurface.nurbs2)
srf_10 = Surface(nurbssurface.nurbs3)
srf_11 = Surface(nurbssurface.nurbs4)
pt_3 = Point(nurbssurface.pts)
srf_12 = Surface(nurbssurface.nurbs5)
pt_4 = Point(nurbssurface.ctrl_pts)
srf_13 = Surface(planesurface.ps)
brep = Brep(unroller.brep)
srf_14 = Surface(surface.srf4)
pt_5 = Point(surface.pt)
pln = Plane(surface.frame)
srf_15 = Surface(surface.rebuilt)
srf_16 = Surface(surface.smooth)
srf_17 = Surface(surface.split_a)
srf_18 = Surface(surface.trimmed)
brep_2 = Brep(surface.brep)
srf_19 = Surface(surface.n_srf)
vdis = VectorDisplay(Anchor=pt_5, Vector=vec)
