# Grasshopper definition 06_Class_Mesh.ghx (Grasshopper 1.0.7)

panel = Panel("Mesh Structure")
box = Box({Plane=PlaneXY(0, 0, 0), X=Domain(-10, 10), Y=Domain(-10, 10), Z=Domain(-10, 10)})
box_2 = Box({Plane=PlaneXY(10, 10, 10), X=Domain(-10, 10), Y=Domain(-10, 10), Z=Domain(-10, 10)})
mesh = Mesh(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)
mesh_2 = GhPythonScript(input_box1=box, input_box2=box_2, input_mesh1=mesh)  # -> out, mesh1, mesh2, mesh3, mesh4, mesh5, mesh6, contour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; inputs input_box1: Box, input_box2: Box, input_mesh1: Mesh
# ---------- mesh_2: Python ----------
__author__ = "trtku"
__version__ = "2021.11.09"

'''
This is a basic documentation about Mesh class in Rhino.Geometry
'''

import Rhino.Geometry as rg



# 0. First of all, there are two different types of representation in rhinocommon: one is class and another one is structure.
#    Basically, structure is memory efficient. See source below if you are curious.
#    https://www.grasshopper3d.com/forum/topics/rhinocommon-structure-types



# 1. Mesh Class
#    https://developer.rhino3d.com/api/RhinoCommon/html/T_Rhino_Geometry_Mesh.htm



# 2. Mesh constructor
#    https://developer.rhino3d.com/api/RhinoCommon/html/Overload_Rhino_Geometry_Mesh__ctor.htm
'''Practically, we dont use Surface constructor in python. Need to use create methods'''



# 3. Mesh methods
#    https://developer.rhino3d.com/api/RhinoCommon/html/Methods_T_Rhino_Geometry_Mesh.htm
'''I skipped similar methods to structure like ClosestPoint (see 02_Structure_Primitives.ghx)'''
'''I skipped barely used methods as well'''

'''create methods'''
# CreateFrom series
x_cnt = 5
y_cnt = 5
z_cnt = 5
mesh1 = rg.Mesh.CreateFromBox(input_box1, x_cnt, y_cnt, z_cnt)
mesh2 = rg.Mesh.CreateFromBox(input_box2, x_cnt, y_cnt, z_cnt)

# CreateBoolean series
mesh3 = rg.Mesh.CreateBooleanDifference([mesh1], [mesh2])
mesh4 = rg.Mesh.CreateBooleanIntersection([mesh1], [mesh2])
mesh5 = rg.Mesh.CreateBooleanSplit([mesh1], [mesh2])
mesh6 = rg.Mesh.CreateBooleanUnion([mesh1, mesh2])

# CreateContourCurves
contourStart = rg.Point3d(0, 0, -10)
contourEnd = rg.Point3d(0, 0, 10)
interval = 1.
contour = rg.Mesh.CreateContourCurves(mesh1, contourStart, contourEnd, interval)

# CreateIcoSphere
sphere = rg.Sphere(rg.Point3d(20, 20, 20), 10)
ico_sphere = rg.Mesh.CreateIcoSphere(sphere, 3)


'''analysis methods'''
# ColorAt
color = mesh1.ColorAt(0, 0., 0., 0., 0.)
print('color', type(color), color)

# ComputeThickness
maximum_thickness = 1.0
thickness = rg.Mesh.ComputeThickness([mesh1], maximum_thickness)
print('thickness', type(thickness), thickness)

# ExtractNonManifoldEdges
#    what is non-Manifold? see page 4
#    https://pages.mtu.edu/~shene/COURSES/cs3621/SLIDES/Mesh.pdf
non_mani = mesh1.ExtractNonManifoldEdges(False)
print('non_mani', type(non_mani), non_mani)

# Get series
naked = input_mesh1.GetNakedEdges()
print('naked', type(naked), naked)

# Is series
mani = input_mesh1.IsManifold()
print('mani', type(mani), mani)

# At series
point = input_mesh1.PointAt(0, 0., 0., 0., 0.)
print('point', type(point), point)

'''edit methods'''
# ExplodeAtUnweldedEdges
mesh_unweld = mesh6[0].ExplodeAtUnweldedEdges()
print('mesh_unweld', type(mesh_unweld), mesh_unweld)

# FillHoles

# MergeAllCoplanarFaces
import Rhino.RhinoMath as rm
lengthtol = rm.DefaultDistanceToleranceMillimeters
angletol = rm.DefaultAngleTolerance
mesh_merged = mesh1.Duplicate()
mesh_merged.MergeAllCoplanarFaces(lengthtol, angletol)
print('mesh_merged', type(mesh_merged), mesh_merged)

# Offset
dist = 3
solidify = True
mesh_offset = input_mesh1.Offset(dist, solidify)
print('mesh_offset', type(mesh_offset), mesh_offset)

# Reduce
mesh_reduced = input_mesh1.Duplicate()
desired_polygon_cnt = 30
allow_distortion = True
accuracy = 1
normalize_size = False
mesh_reduced.Reduce(desired_polygon_cnt, allow_distortion, accuracy, normalize_size)
print('mesh_reduced', type(mesh_reduced), mesh_reduced)

# Smooth
mesh_smooth = mesh_reduced.Duplicate()
smoothFactor = 2.0
bXSmooth = True
bYSmooth = True
bZSmooth = True
bFixBoundaries = True
coordinateSystem = rg.SmoothingCoordinateSystem.World
plane = rg.Plane.WorldXY
mesh_smooth.Smooth(
               smoothFactor,
               bXSmooth,
               bYSmooth,
               bZSmooth,
               bFixBoundaries,
               coordinateSystem,
               plane)
print('mesh_smooth', type(mesh_smooth), mesh_smooth)

# Split
plane = rg.Plane(rg.Point3d(0, 0, 20), rg.Vector3d.ZAxis)
mesh_split = mesh_smooth.Split(plane)
print('mesh_split', type(mesh_split), mesh_split)

# Unweld, Weld


# 4. Mesh properties
#    https://developer.rhino3d.com/api/RhinoCommon/html/Properties_T_Rhino_Geometry_Mesh.htm
'''I skipped same name properties to structure (see 02_Structure_Primitives.ghx)'''

# FaceNormals
#    TODO: extract face normals of Quad face
f_normals = mesh_smooth.FaceNormals
f_normals_cnt = f_normals.Count
f_normals_items = f_normals.Item
face_normals = []
for i in f_normals_items:
    face_normals.append(rg.Vector3d(i))
print('f_normals', type(f_normals), f_normals)
print('f_normals_cnt', type(f_normals_cnt), f_normals_cnt)
print('f_normals_items', type(f_normals_items), f_normals_items)


# Faces
faces = mesh_smooth.Faces
faces_cnt = faces.Count
faces_item = faces.Item
face_centers = []
for i in range(faces_cnt):
    centroid = faces.GetFaceCenter(i)
    face_centers.append(centroid)
print('faces', type(faces), faces)
print('faces_cnt', type(faces_cnt), faces_cnt)
print('faces_item', type(faces_item), faces_item)

# Normals
normals = input_mesh1.Normals
normals_cnt = normals.Count
normals_item = normals.Item
vertex_normals = []
for i in normals_item:
    vertex_normals.append(rg.Vector3d(i))
print('normals', type(normals), normals)
print('normals_cnt', type(normals_cnt), normals_cnt)
print('normals_item', type(normals_item), normals_item)

# Vertices
vertices_list = input_mesh1.Vertices
vertices_cnt = vertices_list.Count
vertices_item = vertices_list.Item
vertices = []
for i in vertices_item:
    vertices.append(i)
print('vertices_list', type(vertices_list), vertices_list)
print('vertices_cnt', type(vertices_cnt), vertices_cnt)
print('vertices_item', type(vertices_item), vertices_item)
# ---------- end mesh_2 ----------
mesh_3 = Mesh(mesh_2.mesh2)
mesh_4 = Mesh(mesh_2.mesh5)
mesh_5 = Mesh(mesh_2.mesh6)
crv = Curve(mesh_2.naked)
pt = Point(mesh_2.point)
mesh_6 = Mesh(mesh_2.mesh_unweld)
mesh_7 = Mesh(mesh_2.mesh_merged)
mesh_8 = Mesh(mesh_2.mesh_offset)
mesh_9 = Mesh(mesh_2.mesh_reduced)
mesh_10 = Mesh(mesh_2.mesh_smooth)
mesh_11 = Mesh(mesh_2.mesh_split)
vec = Vector(mesh_2.face_normals)
vec_2 = Vector(mesh_2.vertex_normals)
pt_2 = Point(mesh_2.vertices)
mesh_12 = Mesh(mesh_2.mesh1)
mesh_13 = Mesh(mesh_2.mesh3)
mesh_14 = Mesh(mesh_2.mesh4)
crv_2 = Curve(mesh_2.contour)
mesh_15 = Mesh(mesh_2.ico_sphere)
pt_3 = Point(mesh_2.face_centers)
multiplication = Multiplication(A=vec, B="10")
multiplication_2 = Multiplication(A=vec_2, B="10")
vdis = VectorDisplay(Anchor=pt_3, Vector=multiplication)
vdis_2 = VectorDisplay(Anchor=pt_2, Vector=multiplication_2)
