# Grasshopper definition 07_Class_MassProperties.ghx (Grasshopper 1.0.7)

srf = Surface(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)
crv = Curve(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)
brep = Brep(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)
panel = Panel("Property Analysis")
volumemassproperties = GhPythonScript(input_brep=brep)  # -> out, centroid; inputs input_brep: Brep
# ---------- volumemassproperties: Python ----------
__author__ = "trtku"
__version__ = "2021.11.09"

'''
This is a basic documentation about VolumeMassProperties class in Rhino.Geometry
'''

import Rhino.Geometry as rg



# 0. First of all, there are two different types of representation in rhinocommon: one is class and another one is structure.
#    Basically, structure is memory efficient. See source below if you are curious.
#    https://www.grasshopper3d.com/forum/topics/rhinocommon-structure-types



# 1. VolumeMassProperties Class
#    https://developer.rhino3d.com/api/RhinoCommon/html/T_Rhino_Geometry_VolumeMassProperties.htm



# 2. VolumeMassProperties methods

VMS = rg.VolumeMassProperties.Compute(input_brep)
print('VMS', type(VMS), VMS)

# 3. VolumeMassProperties properties

volume = VMS.Volume
print('volume', type(volume), volume)

centroid = VMS.Centroid
print('centroid', type(centroid), centroid)
# ---------- end volumemassproperties ----------
lengthmassproperties = GhPythonScript(input_crv=crv)  # -> out, centroid; inputs input_crv: Curve
# ---------- lengthmassproperties: Python ----------
__author__ = "trtku"
__version__ = "2021.11.09"

'''
This is a basic documentation about LengthMassProperties class in Rhino.Geometry
'''

import Rhino.Geometry as rg



# 0. First of all, there are two different types of representation in rhinocommon: one is class and another one is structure.
#    Basically, structure is memory efficient. See source below if you are curious.
#    https://www.grasshopper3d.com/forum/topics/rhinocommon-structure-types



# 1. LengthMassProperties Class
#    https://developer.rhino3d.com/api/RhinoCommon/html/T_Rhino_Geometry_LengthMassProperties.htm



# 2. LengthMassProperties methods

LMS = rg.LengthMassProperties.Compute(input_crv)
print('LMS', type(LMS), LMS)

# 3. LengthMassProperties properties

length = LMS.Length
print('length', type(length), length)

centroid = LMS.Centroid
print('centroid', type(centroid), centroid)
# ---------- end lengthmassproperties ----------
areamassproperties = GhPythonScript(input_srf=srf)  # -> out, centroid; inputs input_srf: Surface
# ---------- areamassproperties: Python ----------
__author__ = "trtku"
__version__ = "2021.11.09"

'''
This is a basic documentation about AreaMassProperties class in Rhino.Geometry
'''

import Rhino.Geometry as rg



# 0. First of all, there are two different types of representation in rhinocommon: one is class and another one is structure.
#    Basically, structure is memory efficient. See source below if you are curious.
#    https://www.grasshopper3d.com/forum/topics/rhinocommon-structure-types



# 1. AreaMassProperties Class
#    https://developer.rhino3d.com/api/RhinoCommon/html/T_Rhino_Geometry_AreaMassProperties.htm



# 2. AreaMassProperties methods
#    https://developer.rhino3d.com/api/RhinoCommon/html/Methods_T_Rhino_Geometry_AreaMassProperties.htm

AMS = rg.AreaMassProperties.Compute(input_srf)
print('AMS', type(AMS), AMS)

# 3. AreaMassProperties properties
#    https://developer.rhino3d.com/api/RhinoCommon/html/Properties_T_Rhino_Geometry_AreaMassProperties.htm

area = AMS.Area
print('area', type(area), area)

centroid = AMS.Centroid
print('centroid', type(centroid), centroid)
# ---------- end areamassproperties ----------
pt = Point(volumemassproperties.centroid)
pt_2 = Point(areamassproperties.centroid)
pt_3 = Point(lengthmassproperties.centroid)
