# Grasshopper definition 08_Namespace_Intersect.ghx (Grasshopper 1.0.7)

srf = Surface(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)
crv = Curve(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)
line = Line(Line((31.41983372, -0.8843043572, 0), (-10.90970827, -24.097279, 0)))
mesh = Mesh(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)
brep = Brep(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)
brep_2 = Brep(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)
srf_2 = Surface(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)
crv_2 = Curve(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)
crv_3 = Curve(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)
line_2 = Line(Line((18.22029912, -20.91118444, 0), (-18.19221012, 19.59773209, 0)))
mesh_2 = Mesh(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)
intersect = GhPythonScript(
    input_brep1=brep,
    input_brep2=brep_2,
    input_srf1=srf,
    input_srf2=srf_2,
    input_crv1=crv_2,
    input_crv2=crv_3,
    input_crv3=crv,
    input_line1=line_2,
    input_line2=line,
    input_mesh1=mesh_2,
    input_mesh2=mesh)  # -> out, arc_a, arc_b, arcarc_pt, brepbrep_crv, brepplane_crv, brepsrf_crv, ci1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; inputs input_brep1: Brep, input_brep2: Brep, input_srf1: Surface, input_srf2: Surface, input_crv1: Curve, input_crv2: Curve, input_crv3: Curve, input_line1: Line, input_line2: Line, input_mesh1: Mesh, input_mesh2: Mesh
# ---------- intersect: Python ----------
__author__ = "trtku"
__version__ = "2021.11.09"

'''
This is a basic documentation about Intersect Namespace in Rhino.Geometry
'''

import Rhino.Geometry as rg



# 0. First of all, there are two different types of representation in rhinocommon: one is class and another one is structure.
#    Basically, structure is memory efficient. See source below if you are curious.
#    https://www.grasshopper3d.com/forum/topics/rhinocommon-structure-types


# 1. Intersect Namespace
#    https://developer.rhino3d.com/api/RhinoCommon/html/N_Rhino_Geometry_Intersect.htm


# 2. Intersection Class
#    https://developer.rhino3d.com/api/RhinoCommon/html/T_Rhino_Geometry_Intersect_Intersection.htm

# ArcArc
import math as m
arc_a = rg.Arc(rg.Plane.WorldXY, 10, m.pi)
arc_b = rg.Arc(rg.Point3d(10, 0, 0), 10, m.pi)
arcarc = rg.Intersect.Intersection.ArcArc(arc_a, arc_b)
arcarc_pt = arcarc[1]
print('arcarc', type(arcarc), arcarc)

# BrepBrep
import Rhino.RhinoMath as rm
tol = rm.DefaultDistanceToleranceMillimeters
brepbrep = rg.Intersect.Intersection.BrepBrep(input_brep1, input_brep2, tol)
brepbrep_crv = brepbrep[1]
print('brepbrep', type(brepbrep), brepbrep)

# BrepPlane
plane = rg.Plane(rg.Point3d(0,0,10), rg.Vector3d.ZAxis)
brepplane = rg.Intersect.Intersection.BrepPlane(input_brep1, plane, tol)
brepplane_crv = brepplane[1]
print('brepplane', type(brepplane), brepplane)

# BrepSurface
brepsrf = rg.Intersect.Intersection.BrepSurface(input_brep1, input_srf1, tol)
brepsrf_crv = brepsrf[1]
print('brepsrf', type(brepsrf), brepsrf)

# CircleCircle
ci1 = rg.Circle(rg.Point3d.Origin, 10)
ci2 = rg.Circle(rg.Point3d(10, 10, 0), 10)
cici = rg.Intersect.Intersection.CircleCircle(ci1, ci2)
cici_pts = cici[1::]
print('cici', type(cici), cici)

# CurveBrep
angle_tol = rm.DefaultAngleTolerance
crvbrep = rg.Intersect.Intersection.CurveBrep(input_crv1, input_brep1, tol, angle_tol)
params = crvbrep[1]
crvbrep_pts = []
for p in params:
    crvbrep_pts.append(input_crv1.PointAt(p))
print('crvbrep', type(crvbrep), crvbrep)

# CurveCurve
crvcrv = rg.Intersect.Intersection.CurveCurve(input_crv1, input_crv2, tol, tol)
print('crvcrv', type(crvcrv), crvcrv)
int_cnt = crvcrv.Count
int_item = crvcrv.Item
print('int_item', type(int_item), int_item)
print('int_cnt', type(int_cnt), int_cnt)
# how to work with intersection event class
#    https://developer.rhino3d.com/api/RhinoCommon/html/T_Rhino_Geometry_Intersect_IntersectionEvent.htm
crvcrv_pts = []
for i in crvcrv.Item:
    print('i', type(i), i)
    is_point = i.IsPoint
    print('is_point', type(is_point), is_point)
    overlapA = i.OverlapA
    print('overlapA', type(overlapA), overlapA)
    overlapB = i.OverlapB
    print('overlapB', type(overlapB), overlapB)
    paramA = i.ParameterA
    print('paramA', type(paramA), paramA)
    paramB = i.ParameterB
    print('paramB', type(paramB), paramB)
    ptA = i.PointA
    print('ptA', type(ptA), ptA)
    ptA2 = i.PointA2
    print('ptA2', type(ptA2), ptA2)
    ptB = i.PointB
    print('ptB', type(ptB), ptB)
    ptB2 = i.PointB2
    print('ptB2', type(ptB2), ptB2)
    
    crvcrv_pts.append(i.PointA)

# CurvePlane
crvplane = rg.Intersect.Intersection.CurvePlane(input_crv2, plane, tol)
crvplane_pts = [i.PointA for i in crvplane.Item]
print('crvplane', type(crvplane), crvplane)

# CurveSelf
crvself = rg.Intersect.Intersection.CurveSelf(input_crv3, tol)
crvself_pts = [i.PointA for i in crvself.Item]
print('crvself_pts', type(crvself_pts), crvself_pts)

# CurveSurface
crvsrf = rg.Intersect.Intersection.CurveSurface(input_crv1, input_srf1, tol, tol)
crvsrf_pts = [i.PointA for i in crvsrf.Item]
print('crvsrf_pts', type(crvsrf_pts), crvsrf_pts)

# LineCircle
lineci = rg.Intersect.Intersection.LineCircle(input_line1, ci1)
lineci_pts = lineci[2::2]
print('lineci', type(lineci), lineci)

# LineLine
lineline = rg.Intersect.Intersection.LineLine(input_line1, input_line2)
lineline_pt = input_line1.PointAt(lineline[1])
print('lineline', type(lineline), lineline)

# MeshMeshAccurate
meshmesh = rg.Intersect.Intersection.MeshMeshAccurate(input_mesh1, input_mesh2, tol)
print('meshmesh', type(meshmesh), meshmesh)

# MeshPlane
meshplane = rg.Intersect.Intersection.MeshPlane(input_mesh2, [rg.Plane.WorldXY])
print('meshplane', type(meshplane), meshplane)

# MeshRay
position = rg.Point3d(0, 0, 0)
direction = rg.Vector3d(1, 0.5, 0)
ray = rg.Ray3d(position, direction)
meshray = rg.Intersect.Intersection.MeshRay(input_mesh2, ray)
pt_on_ray = ray.PointAt(meshray)
print('meshray', type(meshray), meshray)

# PlaneCircle
planeci = rg.Intersect.Intersection.PlaneCircle(rg.Plane.WorldYZ, ci1)
planeci_pt = ci1.PointAt(planeci[1])
print('planeci', type(planeci), planeci)

# PlnaePlane
planeplane = rg.Intersect.Intersection.PlanePlane(rg.Plane.WorldXY, rg.Plane.WorldYZ)
planeplane_line = planeplane[1]
print('planeplane', type(planeplane), planeplane)

# PlanePlanePlane
planeplaneplane = rg.Intersect.Intersection.PlanePlanePlane(rg.Plane.WorldXY, rg.Plane.WorldYZ, rg.Plane.WorldZX)
planeplaneplane_pt = planeplaneplane[1]
print('planeplaneplane', type(planeplaneplane), planeplaneplane)

# Project
import random as r
random_pts = [rg.Point3d(r.randint(-100,100), r.randint(-100,100), r.randint(-100,100)) for i in range(100)]
projection1 = rg.Intersect.Intersection.ProjectPointsToBreps([input_brep1], random_pts, rg.Vector3d.XAxis, tol)
print('projection1', type(projection1), projection1)
projection2 = rg.Intersect.Intersection.ProjectPointsToMeshes([input_mesh1], random_pts, rg.Vector3d.ZAxis, tol)
print('projection2', type(projection2), projection2)

# RayShoot
#different input order gives us a different output!!!
rayshoot1 = rg.Intersect.Intersection.RayShoot([input_brep1], ray, 1)
ray_pts = []
for event in rayshoot1:
    ray_pts.append(event.Point)
print('rayshoot1', type(rayshoot1), rayshoot1)

rayshoot2 = rg.Intersect.Intersection.RayShoot(ray, [input_brep1], 1)
print('rayshoot2', type(rayshoot2), rayshoot2)

# SurfaceSurface
srfsrf = rg.Intersect.Intersection.SurfaceSurface(input_srf1, input_srf2, tol)
srfsrf_crv = srfsrf[1]
print('srfsrf', type(srfsrf), srfsrf)
# ---------- end intersect ----------
arc = CircularArc(intersect.arc_a)
arc_2 = CircularArc(intersect.arc_b)
pt = Point(intersect.arcarc_pt)
crv_4 = Curve(intersect.brepbrep_crv)
crv_5 = Curve(intersect.brepplane_crv)
crv_6 = Curve(intersect.brepsrf_crv)
circle = Circle(intersect.ci1)
circle_2 = Circle(intersect.ci2)
pt_2 = Point(intersect.cici_pts)
pt_3 = Point(intersect.crvbrep_pts)
pt_4 = Point(intersect.crvcrv_pts)
pt_5 = Point(intersect.crvplane_pts)
pt_6 = Point(intersect.crvself_pts)
pt_7 = Point(intersect.crvsrf_pts)
pt_8 = Point(intersect.lineci_pts)
pt_9 = Point(intersect.lineline_pt)
pt_10 = Point(intersect.lineplane_pt)
crv_7 = Curve(intersect.meshmesh)
crv_8 = Curve(intersect.meshplane)
pt_11 = Point(intersect.pt_on_ray)
pt_12 = Point(intersect.planeci_pt)
pt_13 = Point(intersect.planeplaneplane_pt)
pt_14 = Point(intersect.random_pts)
pt_15 = Point(intersect.projection1)
pt_16 = Point(intersect.projection2)
pt_17 = Point(intersect.ray_pts)
pt_18 = Point(intersect.rayshoot2)
crv_9 = Curve(intersect.srfsrf_crv)
