# Grasshopper definition 01_ghpython_normalize_crv.ghx (Grasshopper 1.0.7)

crv = Curve(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)
how_to_normalize_crv_2 = GhPythonScript(crv=crv, param=Slider(1, range=0..1))  # -> out, pts, segments; inputs crv: Curve
# ---------- how_to_normalize_crv_2: Python ----------
import Rhino.Geometry as rg
import ghpythonlib.components as ghc


params = crv.DivideByCount(10, False)
segments = [rg.Curve.Split(crv, p)[0] for p in params]

domain = rg.Interval(0.0 ,1.0)

pts = []
for c in segments:
    # normalize
    c.Domain = domain
    pt = c.PointAt(param)
    pts.append(pt)
# ---------- end how_to_normalize_crv_2 ----------
item = ListItem(List=how_to_normalize_crv_2.segments, Index=Slider(9, range=0..9), Wrap=True)
pt = Point(how_to_normalize_crv_2.pts)

crv_2 = Curve(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)
how_to_normalize_crv_1 = GhPythonScript(crv=crv_2, param=Slider(0, range=0..1))  # -> out, pts, segments; inputs crv: Curve
# ---------- how_to_normalize_crv_1: Python ----------
import Rhino.Geometry as rg
import ghpythonlib.components as ghc


params = crv.DivideByCount(10, False)
segments = rg.Curve.Split(crv, params)

domain = rg.Interval(0.0 ,1.0)

pts = []
for c in segments:
    # normalize
    c.Domain = domain
    pt = c.PointAt(param)
    pts.append(pt)
# ---------- end how_to_normalize_crv_1 ----------
pt_2 = Point(how_to_normalize_crv_1.pts)
item_2 = ListItem(List=how_to_normalize_crv_1.segments, Index=Slider(9, range=0..9), Wrap=True)
