# Grasshopper definition 02_ghpython_collection.ghx (Grasshopper 1.0.7)

point_collection = GhPythonScript()  # -> out, crv
# ---------- point_collection: Python ----------
# import module for geometry
import Rhino.Geometry as rg
# import module for IEnumerable collection
import Rhino.Collections as rc

# make a list of points
pts = [rg.Point3d(0,0,0), rg.Point3d(200,200,0), rg.Point3d(200,400,0), rg.Point3d(0,200,0)]

# make the list IEnumerable
pts = rc.Point3dList(pts)

# create a bezier curve out of the IEnumerable list
crv = rg.BezierCurve(pts)

# convert it into nurbs to visualize
crv = crv.ToNurbsCurve()
# ---------- end point_collection ----------
