# Grasshopper definition 03_ghpython_user_dictionary.ghx (Grasshopper 1.0.7)

mesh = Mesh(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)
class = GhPythonScript(mesh=mesh)  # -> out, mesh; inputs mesh: Mesh
# ---------- class: Python ----------
__author__ = "trtku"
__version__ = "2021.11.22"

# create a key 
key = 'color'
# create a value
val = 'red'
# set the key and value as UserDictionary
mesh.UserDictionary.Set(key, val)

# check the key and value
print(mesh.UserDictionary.Keys)
print(mesh.UserDictionary['color'])
# ---------- end class ----------
python = GhPythonScript(mesh=class.mesh)  # -> out, a; inputs mesh: Mesh
# ---------- python: Python ----------
__author__ = "trtku"
__version__ = "2021.11.22"

# passing a geometry with UserDictionary
print(mesh.UserDictionary.Keys)
print(mesh.UserDictionary['color'])
# ---------- end python ----------

pt = Point(Point(0, 0, 0))
structure = GhPythonScript(p=pt)  # -> out, pt; inputs p: Point3d
# ---------- structure: Python ----------
__author__ = "trtku"
__version__ = "2021.11.22"

# import module
import Rhino.Geometry as rg

# Point3d structure need to be converted into Point class
pt = rg.Point(p)

# set a key
key = 'color'
# set a value
val = 'blue'
# set the key and value as UserDictionary
pt.UserDictionary.Set(key, val)

# check the UserDictionary
print(pt.UserDictionary.Keys)
print(pt.UserDictionary['color'])
# ---------- end structure ----------
structure_2 = GhPythonScript(p=structure.pt)  # -> out, pt; inputs p: Point3d
# ---------- structure_2: Python ----------
__author__ = "trtku"
__version__ = "2021.11.22"

# check the UserDictionary
print(p.UserDictionary.Keys)
print(p.UserDictionary['color'])

# why can't we use this...?
'''
SOURCE for answer:
https://discourse.mcneel.com/t/ghpython-passing-geometry-with-userdictionary-between-components/45622
'''
# ---------- end structure_2 ----------
