# Grasshopper definition 04_ghpython_bake.ghx (Grasshopper 1.0.7)

# ----
# SOURCE: https://gramaziokohler.github.io/teaching_materials/python/
button = Button()
bake_with_color = GhPythonScript(bake=button)
# ---------- bake_with_color: Python ----------
__author__ = "trtku"
__version__ = "2020.10.10"

# import necessary modules
import scriptcontext as sc
import Rhino.DocObjects as rd
import Rhino.Geometry as rg
import System.Drawing as sd
import Rhino

# set an active document
sc.doc = Rhino.RhinoDoc.ActiveDoc

# if bake button is pushed...
if bake:
    # set count for x and z diretion
    x = 10
    z = 10
    # set a box size and tolerance
    boxsize = 1
    tol = 0.1
    
    for i in range(x):
        for j in range(z):
            
            # create a box
            box = rg.Box(rg.Plane.WorldXY, rg.Interval(i, i+boxsize-tol), rg.Interval(0, 1), rg.Interval(j, j+boxsize-tol))
            
            # convert box structure into brep class
            brep = rg.Brep.CreateFromBox(box)
            
            # initiate ObjectAttribute class
            attr = rd.ObjectAttributes()
            
            # set attributes for color
            attr.ColorSource = rd.ObjectColorSource.ColorFromObject
            attr.ObjectColor = sd.Color.FromArgb(i/x*255, j/z*255, 150)
            
            # bake geometry with attributes
            sc.doc.Objects.AddBrep(brep, attr)

'''
In order to see the result, you need to change the display mode to shaded in Rhinoceros
'''
# ---------- end bake_with_color ----------

bake_with_color_as_material = GhPythonScript(bake=Button())
# ---------- bake_with_color_as_material: Python ----------
__author__ = "trtku"
__version__ = "2020.10.10"

# import necessary modules
import scriptcontext as sc
import Rhino.DocObjects as rd
import Rhino.Geometry as rg
import System.Drawing as sd
import Rhino

# set an active document
sc.doc = Rhino.RhinoDoc.ActiveDoc

# if bake button is pushed...
if bake:
    # set count for x and z direction
    x = 10
    z = 10
    # set a box size and tolerance
    boxsize = 1
    tol = 0.1
    
    for i in range(x):
        for j in range(z):
            
            # create a box
            box = rg.Box( rg.Plane.WorldXY, rg.Interval(i, i+boxsize-tol), rg.Interval(0, 1), rg.Interval(j, j+boxsize-tol) )
            
            # convert box into brep
            brep = rg.Brep.CreateFromBox(box)
            
            # get material index
            materialIndex = sc.doc.Materials.Add()
            
            # get material to be edited
            material = sc.doc.Materials[materialIndex]
            
            # set color as material
            material.DiffuseColor = sd.Color.FromArgb(i/x*255, j/z*255, 150)
            
            # commit change
            material.CommitChanges()
            
            # initiate ObjectAttribute class
            attr = rd.ObjectAttributes()
            
            # set attributes for material
            attr.MaterialSource = rd.ObjectMaterialSource.MaterialFromObject
            attr.MaterialIndex = materialIndex
            
            # bake geometry with attributes
            sc.doc.Objects.AddBrep(brep, attr)

'''
In order to see the result, you need to change the display mode to rendered in Rhinoceros
'''
# ---------- end bake_with_color_as_material ----------

bake_with_material = GhPythonScript(bake=Button())
# ---------- bake_with_material: Python ----------
__author__ = "trtku"
__version__ = "2020.10.10"

# import necesary modules
import scriptcontext as sc
import Rhino.DocObjects as rd
import Rhino.Geometry as rg
import System.Drawing as sd
import Rhino

# set an active document
sc.doc = Rhino.RhinoDoc.ActiveDoc

# if bake button is pushed...
if bake:
    # set count for x and z count
    x = 10
    z = 10
    # set a box size and tolerance
    boxsize = 1
    tol = 0.1
    
    for i in range(x):
        for j in range(z):
            
            # create a box
            box = rg.Box( rg.Plane.WorldXY, rg.Interval(i, i+boxsize-tol), rg.Interval(0, 1), rg.Interval(j, j+boxsize-tol) )
            
            # convert a box into brep
            brep = rg.Brep.CreateFromBox(box)
            
            # get material index
            materialIndex = sc.doc.Materials.Add()
            
            # get material to be edited
            material = sc.doc.Materials[materialIndex]
            
            # set different types of colors
            material.AmbientColor = sd.Color.FromArgb(i/x*255, j/z*255, 150)
            material.DiffuseColor = sd.Color.FromArgb(i/x*255, j/z*255, 150)
            material.EmissionColor = sd.Color.FromArgb(i/x*255, j/z*255, 150)
            material.ReflectionColor = sd.Color.FromArgb(i/x*255, j/z*255, 150)
            material.SpecularColor = sd.Color.FromArgb(i/x*255, j/z*255, 150)
            material.Transparency = i/z
            material.TransparentColor = sd.Color.FromArgb(i/x*255, j/z*255, 150)
            material.Shine = 1
            
            # commit change
            material.CommitChanges()
            
            # initiate ObjectAttribute class
            attr = rd.ObjectAttributes()
            
            # set attributes for material
            attr.MaterialSource = rd.ObjectMaterialSource.MaterialFromObject
            attr.MaterialIndex = materialIndex
            
            # bake geometry with attributes
            sc.doc.Objects.AddBrep(brep, attr)

'''
In order to see the result, you need to change the display mode to rendered in Rhinoceros
'''
# ---------- end bake_with_material ----------

bake_into_different_layers = GhPythonScript(bake=Button())
# ---------- bake_into_different_layers: Python ----------
__author__ = "trtku"
__version__ = "2020.10.10"

# import necessary modules
import scriptcontext as sc
import Rhino.DocObjects as rd
import Rhino.Geometry as rg
import System.Drawing as sd
import Rhino

# set an active document
sc.doc = Rhino.RhinoDoc.ActiveDoc

# if bake button is pushed...
if bake:
    # set count for x and z direction
    x = 10
    z = 10
    # set a box size and tolerance
    boxsize = 1
    tol = 0.1
    
    for i in range(x):
        for j in range(z):
            
            # create a box
            box = rg.Box(rg.Plane.WorldXY, rg.Interval(i, i+boxsize-tol), rg.Interval(0,1), rg.Interval(j, j+boxsize-tol))
            
            # convert box structure into brep class
            brep = rg.Brep.CreateFromBox(box)
            
            # initiate ObjectAttribute class
            attr = rd.ObjectAttributes()
            
            # set attributes for color
            attr.ColorSource = rd.ObjectColorSource.ColorFromObject
            attr.ObjectColor = sd.Color.FromArgb(i/x*255, j/z*255, 150)
            
            # create layer names
            layerName = "layer_" + str(i)
            
            # get a layer index for the layername
            layerIndex = sc.doc.Layers.Find(layerName, True)
            # if there is no existing layer...
            if layerIndex < 0:
                # initiate layer object
                layer = rd.Layer()
                # set layer name
                layer.Name = layerName
                # create a new layer
                layerIndex = sc.doc.Layers.Add(layer)
            
            # add attribute for layer
            attr.LayerIndex = layerIndex
            
            # bake the brep with attributes for new layer
            sc.doc.Objects.AddBrep(brep, attr)

'''
In order to see the result, check the layer tab in Rhinoceros
'''
# ---------- end bake_into_different_layers ----------

pidx = Integer(7)
U = Integer(35)
V = Integer(50)
fraction = Number(0.1)
thresh = Number(70)
max_dist = Number(200)
max_thickness = Number(400)
row_col_switch = Number(1)
height_scale = Number(0.6)
keylist = Panel("""Pidx
Ucnt
Vcnt
fraction
thresh
max_dist
max_thickness
switch
height_scale""")
merge = Merge(
    Data1=pidx,
    Data2=U,
    Data3=V,
    Data4=fraction,
    Data5=thresh,
    Data6=max_dist,
    Data7=max_thickness,
    Data8=row_col_switch,
    Data9=height_scale)
valuelist = Panel(merge)
bake_into_different_layers_and_user_text = GhPythonScript(bake=Button(), attributes_values=merge, attributes_keys=keylist)  # inputs attributes_values: list, attributes_keys: list
# ---------- bake_into_different_layers_and_user_text: Python ----------
__author__ = "trtku"
__version__ = "2020.10.10"

'''
usert text can be used to have information in the baekd object
'''

# import necessary modules
import scriptcontext as sc
import Rhino.DocObjects as rd
import Rhino.Geometry as rg
import System.Drawing as sd
import Rhino

# set an active document
sc.doc = Rhino.RhinoDoc.ActiveDoc

# if bake button is pushed...
if bake:
    # set count for x and z direction
    x = 10
    z = 10
    # set a box size and tolerance
    boxsize = 1
    tol = 0.1
    
    for i in range(x):
        for j in range(z):
            
            # create a box
            box = rg.Box(rg.Plane.WorldXY, rg.Interval(i, i+boxsize-tol), rg.Interval(0,1), rg.Interval(j, j+boxsize-tol))
            
            # convert box structure into brep class
            brep = rg.Brep.CreateFromBox(box)
            
            # initiate ObjectAttribute class
            attr = rd.ObjectAttributes()
            
            # set attributes for color
            attr.ColorSource = rd.ObjectColorSource.ColorFromObject
            attr.ObjectColor = sd.Color.FromArgb(i/x*255, j/z*255, 150)
            
            # add attribute for user text
            for k, v in zip(attributes_keys, attributes_values):
                attr.SetUserString(str(k), str(v))
            
            # create layer names
            layerName = "layer_" + str(i)
            
            # get a layer index for the layername
            layerIndex = sc.doc.Layers.Find(layerName, True)
            # if there is no existing layer...
            if layerIndex < 0:
                # initiate layer object
                layer = rd.Layer()
                # set layer name
                layer.Name = layerName
                # create a new layer
                layerIndex = sc.doc.Layers.Add(layer)
            
            # add attribute for layer
            attr.LayerIndex = layerIndex
            
            # bake the brep with attributes for new layer
            sc.doc.Objects.AddBrep(brep, attr)

'''
In order to see the result, check the layer tab and user text tab in the property tab in Rhinoceros
'''
# ---------- end bake_into_different_layers_and_user_text ----------
