# Grasshopper definition 05_ghpython_unpack_tree.ghx (Grasshopper 1.0.7)

mesh = Mesh(graft([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]))
unpack_tree = GhPythonScript(breps=mesh)  # -> breps; inputs breps: tree of Mesh
# ---------- unpack_tree: Python ----------
print('original:\n{}'.format(breps))

#unpack tree in to list of list
breps = [list(b) for b in breps.Branches]

print('unpacked:\n{}'.format(breps))
# ---------- end unpack_tree ----------
