# Grasshopper definition 06_ghpython_read_and_write_json.ghx (Grasshopper 1.0.7)

load = BooleanToggle(False)
load_2 = BooleanToggle(False)
export = BooleanToggle(False)
load_json_context_manager = GhPythonScript(filename="test_json_load", load=load)  # -> out, zero; inputs load: Boolean
# ---------- load_json_context_manager: Python ----------
'''
open a json file by ussing open(), context manager.
SOURCE:
https://realpython.com/python-with-statement/
'''

import ghpythonlib.treehelpers as th
import Rhino.Geometry as rg
import json
import sys
import os

ghComp = ghenv.Component
ghDoc = ghComp.OnPingDocument()

# the full path of the gh file
HERE = ghDoc.FilePath
print('HERE:\n{}'.format(HERE))
# the current directory 
filename += ".json"
path = os.path.abspath(os.path.join(HERE, "..", "data", filename))
print('filepath:\n{}'.format(path))

if load:
    
    # JSON file to read
    file = open(path, mode='r')
    
    # Load the data
    data = json.load(file)
    
    # access a sample key
    zero = data['zero']
    print(zero)
    print('{}.json has been successfully loaded!'.format(filename))
    
    if not file.closed:
        file.close()
# ---------- end load_json_context_manager ----------
load_json_with = GhPythonScript(filename="test_json_load", load=load_2)  # -> out, zero; inputs load: Boolean
# ---------- load_json_with: Python ----------
'''
open a json file by ussing open() and with statement.
SOURCE:
https://realpython.com/python-with-statement/
'''

import ghpythonlib.treehelpers as th
import Rhino.Geometry as rg
import json
import sys
import os

ghComp = ghenv.Component
ghDoc = ghComp.OnPingDocument()

# the full path of the gh file
HERE = ghDoc.FilePath
print('HERE:\n{}'.format(HERE))
# the current directory 
filename += ".json"
path = os.path.abspath(os.path.join(HERE, "..", "data", filename))
print('filepath:\n{}'.format(path))

if load:
    
    # JSON file to read
    with open(path, mode='r') as file:
    
        # Load the data
        data = json.load(file)
        
        # access a sample key
        zero = data['zero']
        print(zero)
        print('{}.json has been successfully loaded!'.format(filename))
# ---------- end load_json_with ----------
export_json_with = GhPythonScript(filename="test_json_export", export=export)  # -> out; inputs export: Boolean
# ---------- export_json_with: Python ----------
'''
open a json file by ussing open() and with statement.
SOURCE:
https://realpython.com/python-with-statement/
'''

import ghpythonlib.treehelpers as th
import Rhino.Geometry as rg
import json
import sys
import os

ghComp = ghenv.Component
ghDoc = ghComp.OnPingDocument()

# the full path of the gh file
HERE = ghDoc.FilePath
print('HERE:\n{}'.format(HERE))
# the current directory 
filename += ".json"
path = os.path.abspath(os.path.join(HERE, "..", "data", filename))
print('filepath:\n{}'.format(path))

# prepare json to export
data = {}
data['filename'] = 'test_file'
data['contents'] = []
for i in range(5):
    data['contents'].append(
    {
    'num_{}'.format(i) : i
    }
    )

if export:
    
    # JSON file to read
    with open(path, mode='w') as file:
    
        # Load the data
        data = json.dump(data, file, indent=4)
        
        print('{}.json has been successfully exported!'.format(filename))
# ---------- end export_json_with ----------
panel = Panel(load_json_context_manager.zero)
panel_2 = Panel(load_json_with.zero)
