# Grasshopper definition 07_ghpython_read_and_write_txt.ghx (Grasshopper 1.0.7)

how_to_write_txt = GhPythonScript(filename="test_file", text="new text")
# ---------- how_to_write_txt: Python ----------
import sys
import os

ghComp = ghenv.Component
ghDoc = ghComp.OnPingDocument()

# the full path of the gh file
path = ghDoc.FilePath
# the current directory 
filename += ".txt"
path = os.path.abspath(os.path.join(path, "...", "data", filename))
print path

f = open(path, "w")
f.write(text)
f.close()
# ---------- end how_to_write_txt ----------
how_to_read_txt = GhPythonScript(filename="test_file")
# ---------- how_to_read_txt: Python ----------
import sys
import os

ghComp = ghenv.Component
ghDoc = ghComp.OnPingDocument()

# the full path of the gh file
path = ghDoc.FilePath
# the current directory 
filename += ".txt"
path = os.path.abspath(os.path.join(path, "...", "data", filename))

f = open(path, "r")
print( f.read() )
f.close()
# ---------- end how_to_read_txt ----------
