# Grasshopper definition 00_versioncheck.ghx (Grasshopper 1.0.7)

version_check = GhPythonScript()  # -> out
# ---------- version_check: Python ----------
__author__ = "trtku"
__version__ = "2021.11.25"

import compas
import compas_ghpython

print(compas.__version__)
print(compas_ghpython.__version__)
# ---------- end version_check ----------
