# Grasshopper definition 01_artist.ghx (Grasshopper 1.0.7)

# ----
# SOURCE: https://compas.dev/compas/latest/api/compas_ghpython.artists.html
# PointArtist
point = GhPythonScript()  # -> out, pt
# ---------- point: Python ----------
__author__ = "trtku"
__version__ = "2021.11.25"

# import modules
import compas_ghpython
from compas.geometry import Point
from compas_ghpython.artists import PointArtist

# set four individual points
pt = Point(0, 0, 0)

# draw points by artist
pa = PointArtist(pt)
pt = pa.draw()
# ---------- end point ----------
points = GhPythonScript()  # -> out, pts
# ---------- points: Python ----------
__author__ = "trtku"
__version__ = "2021.11.25"

# import modules
import compas_ghpython
from compas.geometry import Point
from compas_ghpython.artists import PointArtist

# set four individual points
pt_a = Point(0, 0, 0)
pt_b = Point(10, 0, 0)
pt_c = Point(10, 10, 0)
pt_d = Point(0, 10, 0)

# make a list of points
pts = [pt_a, pt_b, pt_c, pt_d]

# draw points by artist
pts = [PointArtist(p).draw() for p in pts]
# ---------- end points ----------
