# Grasshopper definition 02_mesh.ghx (Grasshopper 1.0.7)

numx = Slider(10, range=0..10)
numy = Slider(10, range=0..10)
sizex = Slider(250, range=0..1000)
sizey = Slider(250, range=0..1000)
z_max = Slider(28, range=1..100)
python = GhPythonScript(numX=numx, numY=numy, sizeX=sizex, sizeY=sizey, z_max=z_max)  # -> out, mesh; inputs numX: Int32, numY: Int32
# ---------- python: Python ----------
# import necessary modules
from compas.geometry import Point
from compas.datastructures import Mesh
from compas_ghpython.artists import MeshArtist, PointArtist
import math
import Rhino.Geometry as rg
import random as r
r.seed(2)

#create base grid by points
def create_grid_mesh ( numX, numY, sizeX, sizeY, z_factor ):
    pts = []
    grid_mesh = []
    
    pitchX = sizeX/numX
    pitchY = sizeY/numY
    
    for i in range(numX):
        for j in range(numY):
            # create a point on the grid with random z value
            pts.append( Point( (i+1) * pitchX, 
                               (j+1) * pitchY,
                               r.uniform(0.0, z_factor) ) )
    
    # create a mesh out of the points
    grid_mesh = Mesh.from_points( pts )
    
    return grid_mesh

# call the function
grid_mesh = create_grid_mesh( numX, numY, sizeX, sizeY, z_max )

# create an artist for mesh
artist = MeshArtist(grid_mesh)

# draw to get Rhino.Geometry
mesh = artist.draw()
# ---------- end python ----------
mesh = Mesh(python.mesh)
