# Grasshopper definition 02_utilities.ghx (Grasshopper 1.0.7)

list_to_ghtree = GhPythonScript()  # -> out, test_tree
# ---------- list_to_ghtree: Python ----------
__author__ = "trtku"
__version__ = "2021.11.25"

'''
SOURCE
https://compas.dev/compas/latest/api/generated/compas_ghpython.utilities.unload_modules.html#compas_ghpython.utilities.unload_modules
'''

# import necessary modules
import Rhino.Geometry as rg
from compas_ghpython import utilities as util

# create a nested list
x, y, z = 10, 10, 10
test_list = [[[rg.Point3d(i, j, k) for k in range(z)] for j in range(y)] for i in range(x)]

# convert nested list into a tree
test_tree = util.list_to_ghtree(test_list)

'''
vice versa function; ghtree_to_list is also availabe
'''
# ---------- end list_to_ghtree ----------
# SOURCE: https://compas.dev/compas/latest/api/compas_ghpython.utilities.html
unload_modules = GhPythonScript()  # -> out
# ---------- unload_modules: Python ----------
__author__ = "trtku"
__version__ = "2021.11.25"

'''
SOURCE
https://compas.dev/compas/latest/api/generated/compas_ghpython.utilities.unload_modules.html#compas_ghpython.utilities.unload_modules
'''

import compas
from compas_ghpython import utilities as util

util.unload_modules('compas')
# ---------- end unload_modules ----------
pt = Point(list_to_ghtree.test_tree)
