# Grasshopper definition 03_proxy.ghx (Grasshopper 1.0.7)

start = BooleanToggle(False)
stop = BooleanToggle(False)
restart = BooleanToggle(False)
python = GhPythonScript(start=start, stop=stop, restart=restart)  # -> out
# ---------- python: Python ----------
'''
SOURCE:
https://compas.dev/compas/latest/tutorial/rpc.html
'''

# import necessary module
from compas.rpc import Proxy

#start server
if start:
    #call proxy server
    np = Proxy('numpy', python='python')
    #restart
    if restart:
        np.restart_server()
    an_array = np.array([[1, 2], [3, 5]])
    print('np', np)
    print('mean', np.mean(an_array))
    print('sum', np.sum(an_array))

#stop server
if stop:
    np.stop_server()
# ---------- end python ----------
