# Grasshopper definition robotic_drawing.ghx (Grasshopper 1.0.7)
# Copyright: © 2021 Ko Tsuruta
# plug-ins: KUKA|prc - parametric robot control

# ----
# run simulation
manual_sim = Slider(0.09, range=0..1)
animate_sim = Panel("1000")
list = ValueList({"animate": 0, "manual": 1}, selected="manual")
smooth = SmoothNumbers(Numbers=animate_sim, SmoothDelay=10000)
dom = ConstructDomain(DomainStart=0, DomainEnd=1)
dom_2 = ConstructDomain(DomainStart=0, DomainEnd=animate_sim)
remap = RemapNumbers(Value=smooth, Source=dom_2, Target=dom)  # -> Mapped, Clipped
filter = StreamFilter(Gate=list, Stream0=remap.Mapped, Stream1=manual_sim)

# ----
# Digital IO
toggle = BooleanToggle(False)

# ----
# check plane
number_slider = Slider(500, range=0..1000)
# Grasshopper example
number_slider_2 = Slider(500, range=0..1000)

# ----
# save file
filename = Panel("test")
save = Button()

# ----
# Python example
filename_2 = Panel("test_manual.src")
crv = Curve(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)
crv_2 = Curve(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)

# ---- group: design
number_slider_3 = Slider(10, range=0..10)
crv_3 = Curve(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)
crv_4 = Curve(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)
subtraction = Subtraction(A=number_slider_3, B=1)
division = Division(A=Slider(1, range=0..1), B=subtraction)
series = Series(Start=0, Step=division, Count=number_slider_3)
tweencrv = TweenCurve(CurveA=crv_4, CurveB=crv_3, Factor=series, BlendType=0)

# ----
# robot model
kr6_10_r1100_2 = AgilusKR610R11002Robot(infiniterot=False)

pt = ConstructPoint(XCoordinate=number_slider, YCoordinate=0, ZCoordinate=number_slider_2)
X = UnitX(Factor=1)
Y = UnitY(Factor=1)
pl = ConstructPlane(Origin=pt, XAxis=expr("-x", X), YAxis=Y)

# ----
# Design
python = GhPythonScript(crv1=crv, crv2=crv_2)  # -> out, twn_crvs; inputs crv1: Curve, crv2: Curve
# ---------- python: Python ----------
"""ABOUT
    This file is an example template of a python file.
"""

# ------------------------------------------------------------------------------
# modules
# ------------------------------------------------------------------------------

import math
import Rhino.Geometry as rg
import Rhino.RhinoMath as rm
import ghpythonlib.treehelpers as th
from krl import KukaPython

# ------------------------------------------------------------------------------
# hard code values
# ------------------------------------------------------------------------------

_hardcode_value = 0
_tolerance = rm.ZeroTolerance
_div_cnt = 10
_twn_cnt = 10

# ------------------------------------------------------------------------------
# functions
# ------------------------------------------------------------------------------

def divide_crv(crv):
    div_pts = []
    div_tans = []
    
    params = rg.Curve.DivideByCount(crv, _div_cnt, True)
    for p in params:
        pt = rg.Curve.PointAt(crv, p)
        norm = rg.Curve.TangentAt(crv, p)
        
        div_pts.append(pt)
        div_tans.append(norm)
    
    return div_pts, div_tans

# ------------------------------------------------------------------------------
# classes
# ------------------------------------------------------------------------------

# ------------------------------------------------------------------------------
# run code
# ------------------------------------------------------------------------------



# tween curve
twn_crvs = rg.Curve.CreateTweenCurves(crv1, crv2, _twn_cnt, _tolerance)
# ---------- end python ----------

# ----
# KRL
kuka_code = GhPythonScript(twn_crvs=python.twn_crvs, filename=filename_2, save=Toggle(False))  # -> out, krl_code; inputs twn_crvs: list of Curve, save: Boolean
# ---------- kuka_code: Python ----------
"""ABOUT
    This file is an example template of a python file.
"""

# ------------------------------------------------------------------------------
# modules
# ------------------------------------------------------------------------------

import compas_ghpython
from krl import KukaPython
import math
import Rhino.Geometry as rg
import Rhino.RhinoMath as rm
import ghpythonlib.treehelpers as th

# ------------------------------------------------------------------------------
# hard code values & routines
# ------------------------------------------------------------------------------

compas_ghpython.utilities.unload_modules("krl")

_hardcode_value = 0
_tolerance = rm.ZeroTolerance
_div_cnt = 10
_twn_cnt = 10
# tool coordinates
tx, ty, tz, ta, tb, tc = 0, 0, 0, 0, 0, 0
# base coordinates
bx, by, bz, ba, bb, bc = 0, 0, 0, 0, 0, 0

# ------------------------------------------------------------------------------
# functions
# ------------------------------------------------------------------------------
def divide_crv(crv):
    div_pts = []
    div_tans = []
    div_curvature = []
    
    params = rg.Curve.DivideByCount(crv, _div_cnt, True)
    for p in params:
        pt = rg.Curve.PointAt(crv, p)
        norm = rg.Curve.TangentAt(crv, p)
        curvature = rg.Curve.CurvatureAt(crv, p)
        
        div_pts.append(pt)
        div_tans.append(norm)
        div_curvature.append(curvature)
    
    return div_pts, div_tans, div_curvature

def map(value, low1, high1, low2, high2):
    
    return low2 + (value - low1) * (high2 - low2) / (high1 - low1)
# ------------------------------------------------------------------------------
# classes
# ------------------------------------------------------------------------------

# ------------------------------------------------------------------------------
# run code
# ------------------------------------------------------------------------------

# initialize kukapython
k = KukaPython("kr10r11002")

# run code
k.setOutput(1, "TRUE")

for i, c in enumerate(twn_crvs):
    pts, tans, curvatures = divide_crv(c)
    
    min_curva = min(curvatures)
    max_curva = max(curvatures)
    
    # flip list
    if i%2 == 1:
        pts.reverse()
        tans.reverse()
        curvatures.reverse()
    
    # create code per point
    for p, t, c in zip(pts, tans, curvatures):
        norm = rg.Vector3d.CrossProduct(t, rg.Vector3d.ZAxis)
        
        v_radians = rg.Vector3d.VectorAngle(norm, rg.Vector3d.YAxis, rg.Vector3d.ZAxis)
        v_degree = math.degrees(v_radians)
        k.LIN(p.X, p.Y, p.Z, a=0, b=-90, c=v_degree, e1=0, e2=0)
        
        vel = map(c.Length, min_curva.Length, max_curva.Length, 0.1, 0.25)
        k.setVelocity(vel)

k.setOutput(1, "FALSE")
k.PTP(5, -90, 100, 5, 10, -5, 0, 0)


# save code
if save:
    KRL = k.saveFile(filename)
    krl_code = ""
    for krl in KRL:
        krl_code += krl
        krl_code += "\n"
# ---------- end kuka_code ----------

panel = Panel(kuka_code.krl_code)

# ---- group: flip
dispatch = Dispatch(List=tweencrv, DispatchPattern=[True, False])  # -> ListA, ListB
flip = FlipCurve(Curve=dispatch.ListB)  # -> Curve, Flag
weave = Weave(Pattern=[0, 1], Stream0=dispatch.ListA, Stream1=flip.Curve, NullGaps=False)

# ---- group: create plane
divide = DivideCurve(Curve=weave, Count=10, Kinks=False)  # -> Points, Tangents, Parameters
eval = EvaluateCurve(Curve=graft(weave), Parameter=divide.Parameters)  # -> Point, Tangent, Angle
Z = UnitZ(Factor=1)
xprod = CrossProduct(VectorA=Z, VectorB=eval.Tangent, Unitize=False)  # -> Vector, Length
pl_2 = ConstructPlane(Origin=eval.Point, XAxis=xprod.Vector, YAxis=eval.Tangent)
vdis = VectorDisplay(Anchor=eval.Point, Vector=xprod.Vector)
flatten = FlattenTree(Tree=pl_2, Path="{0}")
pln = Plane(flatten)

# ---- group: velocity
curvature = Curvature(Curve=graft(weave), Parameter=divide.Parameters)  # -> P, K, C
vlen = VectorLength(Vector=curvature.K)
flatten_2 = FlattenTree(Tree=vlen, Path="{0}")
sort = SortList(Keys=flatten_2)  # -> Keys, ValuesA
item = ListItem(List=sort.Keys, Index=0, Wrap=True)  # -> Item1, Item
dom_3 = ConstructDomain(DomainStart=item.Item, DomainEnd=item.Item1)
dom_4 = ConstructDomain(DomainStart=Slider(0.1, range=0..0.1), DomainEnd=Slider(0.25, range=0..1))
remap_2 = RemapNumbers(Value=vlen, Source=dom_3, Target=dom_4)  # -> Mapped, Clipped
flatten_3 = FlattenTree(Tree=remap_2.Mapped, Path="{0}")
num = Number(flatten_3)

# ----
# KUKA
# COMMANDs
ptp_move = PTPMovementKUKAPrc(extaxenabled=False, interpolation="C_PTP")
digital_out = DigitalOutputKUKAPrc(DigitalOutputNumber=1, OutputState=toggle, ContinuousMovement=Toggle(True), ToolState=-1)
digital_out_2 = DigitalOutputKUKAPrc(DigitalOutputNumber=1, OutputState=Toggle(True), ContinuousMovement=Toggle(True), ToolState=-1)
analog_out = AnalogOutputKUKAPrc(AnalogOutputNumber=1, OutputState=0, ContinuousMovement=False)
cir_move = CIRcularMovementKUKAPrc(extaxenabled=False, interpolation="C_DIS")
spl_move = SPLineMovementKUKAPrc(extaxenabled=False, interpolation="C_DIS")
lin_move = LINearMovementKUKAPrc(TargetAsPlane=pln, Speed=num, extaxenabled=False, interpolation="C_DIS")
axis_move = AXISMovementKUKAPrc(Axis1=0, Axis2=-90, Axis3=90, Axis4=0, Axis5=0, Axis6=0, extaxenabled=False, interpolation="C_PTP")
wait_for = WaitForDigitalInputKUKAPrc(DigitalInput=1)
wait = WaitKUKAPrc(KUKAPrcWait=1)

merge = Merge(Data1=digital_out_2, Data2=lin_move, Data3=digital_out)
group = GroupUngroupCommandsKUKAPrc(GroupCommands=merge)

# ----
# KUKA core
kuka_prc = KUKAPrcCORE(
    SimulationSlider=filter,
    KUKAPrcCommands=group,
    Robot=kr6_10_r1100_2,
    SaveToggle=save,
    Filename=filename,
    PRC_BaseExpose=False,
    PRC_SaveNameExpose=True,
    PRCsettings="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")  # -> RobotGeometry, AnalysisOutput
